# Grasshopper definition wallSystem4.gh (Grasshopper 1.0.7)
# plug-ins: Human, Kangaroo Components

panel = Panel("py\tileDefinition.py")  # disabled
panel_2 = Panel("py\structAndFillDefinition.py")  # disabled
panel_3 = Panel("py\boardDefinition.py")  # disabled
panel_4 = Panel("py\substructionDefinition.py")  # disabled
panel_5 = Panel("py\paintDefinition.py")  # disabled
number_slider = Slider(43, range=0..100)  # disabled
number_slider_2 = Slider(36, range=0..100)  # disabled
number_slider_3 = Slider(24, range=0..100)  # disabled
python = GhPythonScript()  # -> out, a; disabled
# ---------- python: Python ----------
import sys
import os

path = ghenv.Component.OnPingDocument().FilePath
parentdir = os.path.dirname(path)
grandparentdir = os.path.dirname(parentdir)
dire = os.path.join(grandparentdir, 'py')
if dire not in sys.path:
    sys.path.append(dire)

# Import your module
import testing
# Reload the module to ensure any changes are reflected
reload(testing)

from testing import JoJo

ohoh = JoJo(12,3)

ohoh.addd()
ohoh.mult()
# ---------- end python ----------
python_2 = GhPythonScript()  # -> out, a; inputs brep: Guid; disabled
# ---------- python_2: Python ----------
import Rhino
import scriptcontext as sc
import rhinoscriptsyntax as rs

# Set scriptcontext.doc to Rhino's document to access its objects
sc.doc = Rhino.RhinoDoc.ActiveDoc


def get_user_text_from_object(object_id, key=None):
    """
    Get user text from an object by its ID.
    """
    if object_id is None:
        print("No object ID provided.")
        return None

    rhino_object = sc.doc.Objects.Find(object_id)
    if not rhino_object:
        print("Object not found.")
        return None

    if key:
        value = rhino_object.Attributes.GetUserString(key)
        print("User text for key '{}': {}".format(key, value))
        return value
    else:
        all_user_text = rhino_object.Attributes.GetUserStrings()
        for k in all_user_text.AllKeys:
            print("Key: '{}', Value: '{}'".format(k, all_user_text[k]))
        return all_user_text

# Get the object ID by the referenced Brep geometry
#object_id = find_object_id_by_guid(brep)  # Assuming 'brep' is your input Brep

#print(object_id)
# To get user text
get_user_text_from_object(brep)
# ---------- end python_2 ----------
tiledb = TileDB()  # disabled
connecttofile = GhPythonScript()  # -> out, a
# ---------- connecttofile: Python ----------
fileName = "wallDefinition3.py"
folderName = "py"

import sys
import os
import Grasshopper

# Access the current Grasshopper document
gh_doc = ghenv.Component.OnPingDocument()

# Get the file path of the current document
file_path = gh_doc.FilePath

# Verify that the document has been saved and file_path is valid
if not file_path:
    raise ValueError("The Grasshopper document needs to be saved to access its path.")

# Construct the path to the external script
script_dir = os.path.dirname(file_path)  # One level up from the file
script_dir = os.path.dirname(script_dir)  # Two levels up from the file
script_path = os.path.join(script_dir, folderName, fileName)  # Path to the script

# Ensure the script directory is in sys.path
script_dir = os.path.dirname(script_path)
if script_dir not in sys.path:
    sys.path.append(script_dir)

# Read and execute the script safely
try:
    with open(script_path, 'r') as file:
        script_content = file.read()
        exec(script_content, globals())
except IOError:
    print("Failed to open or read the script file at {}".format(script_path))
except Exception as e:
    print("Error executing the script: {}".format(e))
# ---------- end connecttofile ----------
python_3 = GhPythonScript()  # -> out, a; disabled
# ---------- python_3: Python ----------
################################################################################
# SampleEtoViewCaptureDialog.py
# MIT License - Copyright (c) 2017 Robert McNeel & Associates.
# See License.md in the root of this repository for details.
################################################################################

# Imports from
from Rhino.UI import *
from Eto.Forms import *
from Eto.Drawing import *

# Imports
import Rhino
import Rhino.UI
import Eto
import scriptcontext
import System

################################################################################
# SampleEtoViewCaptureDialog dialog class
################################################################################
class SampleEtoViewCaptureDialog(Eto.Forms.Dialog[bool]):
    
    # Class initializer
    def __init__(self):
        # Initialize dialog box
        self.Title = 'SampleEtoViewCaptureDialog'
        self.Padding = Padding(10)
        # Create a table layout and add all the controls
        layout = TableLayout()
        layout.Padding = Padding(10)
        layout.Spacing = Size(5, 5)
        layout.Rows.Add(self.CreateLabel())
        layout.Rows.Add(self.CreateImageView())
        layout.Rows.Add(None) # spacer
        layout.Rows.Add(self.CreateButtons())
        # Set the dialog content
        self.Content = layout
    
    # Create the dialog label
    def CreateLabel(self):
        self.m_label = Label(Text = 'Click the "Capture" button...')
        return self.m_label
    
    # Create the dialog image list
    def CreateImageView(self):
        self.m_image_view = ImageView()
        self.m_image_view.Size = Size(300, 200)
        self.m_image_view.Image = None
        return self.m_image_view
    
    # Close button click handler
    def OnCloseButtonClick(self, sender, e):
        rc = self.m_image_view.Image is not None
        if rc:
            self.Close(True)
        else:
            self.Close(False)
        
    # Capture button click handler 
    def OnCaptureButtonClick(self, sender, e): 
        # Capture the active view to a System.Drawing.Bitmap
        view = scriptcontext.doc.Views.ActiveView
        bitmap = view.CaptureToBitmap()
        # Convert the System.Drawing.Bitmap to an Eto.Drawing.Bitmap
        # which is required for an Eto image view control
        stream = System.IO.MemoryStream()
        format = System.Drawing.Imaging.ImageFormat.Png
        System.Drawing.Bitmap.Save(bitmap, stream, format)
        if stream.Length != 0:
          self.m_image_view.Image = Bitmap(stream)
        stream.Dispose()
        # Update the text label
        self.m_label.Text = 'Captured view: {}'.format(view.ActiveViewport.Name)
        # Disable the default button
        self.DefaultButton.Enabled = False

    # Create the dialog buttons
    def CreateButtons(self):
        # Create the default button
        self.DefaultButton = Button(Text = 'Capture')
        self.DefaultButton.Click += self.OnCaptureButtonClick
        # Create the abort button
        self.AbortButton = Button(Text = 'Close')
        self.AbortButton.Click += self.OnCloseButtonClick
        # Create button layout
        button_layout = TableLayout()
        button_layout.Spacing = Size(5, 5)
        if Rhino.Runtime.HostUtils.RunningOnWindows:
            button_layout.Rows.Add(TableRow(None, self.DefaultButton, self.AbortButton))
        else:
            button_layout.Rows.Add(TableRow(None, self.AbortButton, self.DefaultButton))
        return button_layout
        
    # Returns the captured image
    def Image(self):
        return self.m_image_view.Image
    
################################################################################
# Function to test the capture dialog
################################################################################
def TestSampleEtoViewCaptureDialog():
    dialog = SampleEtoViewCaptureDialog();
    rc = dialog.ShowModal(RhinoEtoApp.MainWindow)
    if (rc):
        print 'have image'
    
################################################################################
# Check to see if this file is being executed as the "main" python
# script instead of being used as a module by some other python script
# This allows us to use the module which ever way we want.
################################################################################
if __name__ == "__main__":
    TestSampleEtoViewCaptureDialog()
# ---------- end python_3 ----------
python_4 = GhPythonScript(number=number_slider_2)  # -> out, a; disabled
# ---------- python_4: Python ----------
import Eto.Forms as forms
import Eto.Drawing as drawing

class NumberDisplayForm(forms.Form):
    def __init__(self):
        super(NumberDisplayForm, self).__init__()
        self.Title = "Number Display"
        self.ClientSize = drawing.Size(300, 100)
        self.Padding = drawing.Padding(10)

        # Label to display the number
        self.numberLabel = forms.Label(Text="No number yet", 
                                       VerticalAlignment=forms.VerticalAlignment.Center, 
                                       TextAlignment=forms.TextAlignment.Center,
                                       Font=drawing.Font("Verdana", 12))

        # Set the label to the content of the form
        self.Content = self.numberLabel

    def update_number(self, number):
        # Method to update the label text with the new number
        self.numberLabel.Text = str(number)

def RunScript(number):
    # Ensure the form exists and is visible
    if "my_form" in globals():
        if my_form.Visible:
            # Update the form with the current number input
            my_form.update_number(number)
        else:
            # The form was closed, remove it
            del globals()["my_form"]
    else:
        # Form does not exist, create and show it
        global my_form
        my_form = NumberDisplayForm()
        my_form.Show()

    return 0

RunScript(number)
# ---------- end python_4 ----------
c__grasshoppername = CSharpScript(inputName=panel)  # -> ghParentPath, filePath; inputs inputName: String; disabled; same code as c__grasshoppername
c__grasshoppername_2 = CSharpScript(inputName=panel_3)  # -> ghParentPath, filePath; inputs inputName: String; disabled; same code as c__grasshoppername
c__grasshoppername_3 = CSharpScript(inputName=panel_2)  # -> ghParentPath, filePath; inputs inputName: String; disabled; same code as c__grasshoppername
c__grasshoppername_4 = CSharpScript(inputName=panel_4)  # -> ghParentPath, filePath; inputs inputName: String; disabled; same code as c__grasshoppername
c__grasshoppername_5 = CSharpScript(inputName=panel_5)  # -> ghParentPath, filePath; inputs inputName: String; disabled; same code as c__grasshoppername
panel_6 = Panel(python_2.out)  # disabled
python_5 = GhPythonScript(numbers=[number_slider, number_slider_3])  # -> out, a; inputs numbers: list; disabled
# ---------- python_5: Python ----------
import Eto.Forms as forms
import Eto.Drawing as drawing

class NumberDisplayForm(forms.Form):
    def __init__(self):
        super(NumberDisplayForm, self).__init__()
        self.Title = "Numbers Display"
        self.ClientSize = drawing.Size(300, 200)  # Increased size for better visibility
        self.Padding = drawing.Padding(10)

        # Multi-line text area to display the numbers
        self.numbersTextArea = forms.TextArea(ReadOnly=True, 
                                              Font=drawing.Font("Consolas", 10), 
                                              Wrap = False)
        self.numbersTextArea.Text = "noooo"
        self.Content = self.numbersTextArea

    def update_numbers(self, numbers):
        # Update the text area with numbers formatted as strings
        numList = []
        for num in numbers:
            numList.append(str(num))
        self.numbersTextArea.Text = '\n'.join(numList)

def RunScript(numbers):
    # Ensure the form exists and is visible
    if "my_form" in globals():
        if my_form.Visible:
            # Update the form with the current list of numbers
            my_form.update_numbers(numbers)
        else:
            # The form was closed, remove it
            del globals()["my_form"]
    else:
        # Form does not exist, create and show it
        global my_form
        my_form = NumberDisplayForm()
        my_form.Show()

    return 0

RunScript(numbers)
# ---------- end python_5 ----------
panel_7 = Panel("""bauteil_obergruppe
bauteil_gruner
uuid
kosten
zustand
material
ref_gebauede_geschoss
breite
hoehe
tiefe
flaeche
masse
anzahl
foto1
foto2
co2
url""")

# ----
# json folder path
c__grasshoppername_6 = CSharpScript(inputName="DB\JSON_data\JSON")  # -> ghParentPath, filePath; inputs inputName: String; same code as c__grasshoppername

# ----
# UI item setting
# Tick the items which you
# want  to show inside UI.
list = ValueList({"bauteil_obergruppe", "bauteil_gruner", "uuid", "kosten", "zustand", "material", "ref_gebauede_geschoss", "breite", "hoehe", "tiefe", "flaeche", "masse", "anzahl"}, selected=["bauteil_obergruppe", "bauteil_gruner", "material", "breite", "hoehe", "tiefe", "anzahl"])

# ----
# Sort list by which item,
# Original order if disable.
list_2 = ValueList({"breite", "hoehe", "tiefe", "anzahl"}, selected="anzahl")

# ----
# True: Large -> Small
# False: Small -> Large
toggle = BooleanToggle(True)

# ----
# img folder path
c__grasshoppername_7 = CSharpScript(inputName="DB\Pictures_gruner")  # -> ghParentPath, filePath; inputs inputName: String; same code as c__grasshoppername

# ----
# read json file
python_6 = GhPythonScript(folder_path=c__grasshoppername_6.filePath)  # -> title, data
# ---------- python_6: Python ----------
import os
import json
import ghpythonlib.treehelpers as th

item_list = ['bauteil_obergruppe', 'bauteil_gruner', 'uuid', 'kosten', 'zustand', 'material', 'ref_gebauede_geschoss', 'breite', 'hoehe', 'tiefe', 'flaeche', 'masse', 'anzahl', 'foto1', 'foto2', 'co2', "kategorie"]

nameDict = {
"Befoerderungsanlage.json":"Befoerderungs_Anlage", #
"Bodenbelag.json":"Bodenbelag", #
"Deckenbekleidung.json":"Deckenbekleidung", #
"Deckenkonstruktion Dachkonstruktion.json":"Deckenkonstruktion", #
"Einbauten Schutzeinrichtung zu Ausbau.json":"Schutzeinrichtung", #
"Element in Aussenwand.json":"Aussenwand", #
"Element zu Dach.json":"ElementZuDach", #
"Fundament Bodenplatte.json":"Bodenplatte", #
#"Gastechnische Anlage.json":"Gastechnische_Anlage", 
"Gruenflaeche.json":"Gruenflaeche", #
"Kleininventar.json":"Kleininventar", #
"Lufttechnische Anlage.json":"Lufttechnische_Anlage", #
"Mobiliar.json":"Mobiliar", #
#"Sicherheitsanlage.json":"Sicherheit_Anlage", 
"Stuetzenkonstruktion.json":"Stuetzenkonstruktion", #
"Textilien.json":"Textilien", #
"Trennwand Innentuer Innentor.json":"Trennwand", #
"Waermetechnische Anlage.json":"Waermetechnische_Anlage", #
"Wandbekleidung.json":"Wandbekleidung", #
"Wandkonstruktion.json":"Wandkonstruktion", #
"Wassertechnische Anlage.json":"Wassertechnische_Anlage", #
"Weitere nutzungsspezifische Anlage.json":"Nutzungsspezifische_Anlage" #
}

def read_json_files(folder_path):
    # List to hold all items, with each item's sub-items as sub-lists
    all_items = []
    
    # Iterate over all files in the given folder
    for file_name in os.listdir(folder_path):
        # Check if the file is a JSON file
        if file_name.endswith('.json'):
            full_path = os.path.join(folder_path, file_name)
            
            # Read the JSON file
            with open(full_path, 'r') as json_file:
                data = json.load(json_file)
                
                # Assuming 'data' is a list of items
                for item in data:
                    # Add each item (and its sub-items, if any) to the list
                    
                    if file_name not in nameDict.keys():
                        continue
                    item["kategorie"] = nameDict[file_name]
                    temp = []
                    for key in item_list:
                        if key not in item.keys():
                            temp.append("FALSE")
                        else:
                            temp.append(item[key])
                    
                    all_items.append(temp)
    
    # Convert the list of lists into a data tree, with each top-level list as a branch
    return th.list_to_tree(all_items)

# Call the function and store the result
data = read_json_files(folder_path)

# The 'data_tree' can now be used as output in your Grasshopper Python component
title = item_list
# ---------- end python_6 ----------

xz = XZPlane(Origin=Point(0, 0, 0))
xz_2 = XZPlane(Origin=Point(0, 0, 0))
recgrid = Rectangular(Plane=xz, SizeX=Slider(100, range=0..100), SizeY=Slider(54, range=0..100), ExtentX=10, ExtentY=5)  # -> Cells, Points
changeimgpath = ChangeImgPath(parent_folder=c__grasshoppername_7.filePath, relay=python_6.data)
explode = Explode(Curve=recgrid.Cells, Recursive=True)  # -> Segments, Vertices
number_slider_4 = Slider(46, range=0..100)
number_slider_5 = Slider(46, range=0..100)
pt = Point(Point(413.8512714, -5.49793914, 189.0688264))
number_slider_6 = Slider(31, range=0..100)
number_slider_7 = Slider(31, range=0..100)

# ----
# press it when you want to open UI
button = Button()

pt_2 = Point(Point(307.331237, -3.568335323, 203.4638))
item = ListItem(List=explode.Segments, Index=0, Wrap=True)  # -> flatten(Item), flatten(Item1), flatten(Item2), flatten(Item3)
project = Project(Geometry=pt_2, Plane=xz_2)  # -> Geometry, Transform
project_2 = Project(Geometry=pt, Plane=xz_2)  # -> Geometry, Transform
dupln = RemoveDuplicateLines(Lines=[item.Item, item.Item2], Tolerance=0.01)
dupln_2 = RemoveDuplicateLines(Lines=[item.Item1, item.Item3], Tolerance=0.01)
dom = ConstructDomain(DomainStart=expr("-x", number_slider_6), DomainEnd=number_slider_6)
dom_2 = ConstructDomain(DomainStart=expr("-x", number_slider_7), DomainEnd=number_slider_7)
dom_3 = ConstructDomain(DomainStart=expr("-x", number_slider_4), DomainEnd=number_slider_4)
dom_4 = ConstructDomain(DomainStart=expr("-x", number_slider_5), DomainEnd=number_slider_5)
xz_3 = XZPlane(Origin=project.Geometry)
xz_4 = XZPlane(Origin=project_2.Geometry)
c__grasshoppername_8 = CSharpScript(inputName="py\alignSystem.py")  # -> ghParentPath, filePath; inputs inputName: String; same code as c__grasshoppername
join = JoinCurves(Curves=dupln, Preserve=False)
join_2 = JoinCurves(Curves=dupln_2, Preserve=False)
file = ReadFile(File=c__grasshoppername_8.filePath, PerLineParse=False)
rectangle = Rectangle(Plane=xz_4, XSize=dom, YSize=dom_3, Radius=0)  # -> Rectangle, Length
rectangle_2 = Rectangle(Plane=xz_3, XSize=dom_2, YSize=dom_4, Radius=0)  # -> Rectangle, Length
crv = Curve([join, join_2])
merge = Merge(Data1=rectangle.Rectangle, Data2=rectangle_2.Rectangle)

# ----
# This one is temp, should be changed
panel_8 = Panel("Innentuer")
cluster = Cluster_5(bauteil_obergruppe="Trennwand, Innentuer, Innentor", bauteil_obergruppe_2=panel_8, data=changeimgpath)  # -> data_4, num_2
panel_9 = Panel(cluster.num_2)
boarddb = BoardDB_2(data=cluster.data_4)

python_7 = GhPythonScript(Code=file, WindowGeo=merge, Grid=crv, Toler=Slider(10, range=0..10), BasePlane=xz)  # -> Out, A, B, C, D
cluster_2 = Cluster_5(bauteil_obergruppe="Trennwand, Innentuer, Innentor", bauteil_obergruppe_2="Innentuer", data=changeimgpath)  # -> data_4, num_2
cluster_3 = Cluster_5(bauteil_obergruppe="Element in Aussenwand", bauteil_obergruppe_2="Fenster", data=changeimgpath)  # -> data_4, num_2

# ----
# UI Engine
number_slider_8 = Slider(8, range=6..10, expression="x*100")
cluster_4 = Cluster_4(
    openui=button,
    winheight=number_slider_8,
    rownum=Slider(4, range=0..10),
    showitemnum=Slider(200, range=0..1000),
    page=Slider(1, range=0..10),
    topic=["bauteil_obergruppe", "bauteil_gruner", "uuid", "kosten", "zustand", "material", "ref_gebauede_geschoss", "breite", "hoehe", "tiefe", "flaeche", "masse", "anzahl", "foto1", "foto2", "co2", "url"],
    chosenitem=list,
    data=cluster_3.data_4,
    sortitem=list_2,
    sortreverse=toggle)  # -> data_5, checkbox_states

# ----
# Synthetic data, should be changed
number_slider_9 = Slider(200, range=0..1000)
tilemockdata = TileMockData(num=number_slider_9)

python_8 = GhPythonScript(x=python_7.C)  # -> out, a
# ---------- python_8: Python ----------
a = x
# ---------- end python_8 ----------
panel_10 = Panel(python_7.Out)
panel_11 = Panel(cluster_2.num_2)
move = Move(Geometry=merge, Motion=python_7.A)  # -> Geometry, Transform
panel_12 = Panel(cluster_3.num_2)
doordb = DoorDB(data=cluster_2.data_4)
windowdb = WindowDB(data=cluster_3.data_4)
previewlw = CustomPreviewLineweights(
    Geometry=move.Geometry,
    Shader={diffuse=RGB(255, 105, 180), emission=RGB(76, 32, 54), shine=0.5, specular=RGB(255, 255, 255), transparency=0},
    Thickness=Slider(5, range=0..10),
    Absolute=False)

# ----
# json folder path
c__grasshoppername_9 = CSharpScript(inputName="DB\JSON_data\JSON")  # -> ghParentPath, filePath; inputs inputName: String; same code as c__grasshoppername

python_9 = GhPythonScript()  # -> out, a
# ---------- python_9: Python ----------
import Rhino.Geometry as rg
from ghpythonlib.components import LineSDL, CurveXCurve

a = rg.Point3d(0,0,0)
b = rg.Point3d(0,0,0)

print(a == b)
# ---------- end python_9 ----------

# ----
# Title List
panel_13 = Panel("""bauteil_obergruppe
bauteil_gruner
uuid
kosten
zustand
material
ref_gebauede_geschoss
breite
hoehe
tiefe
flaeche
masse
anzahl
foto1
foto2
co2
url""")

# ----
# img folder path
c__grasshoppername_10 = CSharpScript(inputName="DB\Pictures_gruner")  # -> ghParentPath, filePath; inputs inputName: String; same code as c__grasshoppername

# ----
# read json file
python_10 = GhPythonScript(folder_path=c__grasshoppername_9.filePath)  # -> title, data; same code as python_6

changeimgpath_2 = ChangeImgPath(parent_folder=c__grasshoppername_10.filePath, relay=python_10.data)
data = Data(changeimgpath_2)
title = Data(panel_13)

# ----
# Filter for Category
# This filter module is specifically for content that is 'category.'
list_3 = ValueList({"bauteil_obergruppe", "bauteil_gruner", "material"}, selected="bauteil_obergruppe")
# Filter Block
# Filter Blocks can be copied to apply multiple filters.
# Users can select a topic to view the involved items.
# By selecting the items, materials whose content matches the filter will be retained.
panel_14 = Panel("""bauteil_obergruppe
bauteil_gruner
material""")
cluster_5 = Cluster(S=title, M=list_3, data=data)  # -> S_2, M_2, L
panel_15 = Panel(cluster_5.L)
list_4 = ItemSelector(
    cluster_5.S_2,
    {"Befoerderungsanlage", "Bodenbelag", "Deckenbekleidung", "Deckenkonstruktion, Dachkonstruktion", "Einbauten, Schutzeinrichtung zu Ausbau", "Element in Aussenwand", "Element zu Dach", "Fundament, Bodenplatte", "Gruenflaeche", "Kleininventar", "Lufttechnische Anlage", "Mobiliar", "Stuetzenkonstruktion", "Textilien", "Trennwand, Innentuer, Innentor", "Waermetechnische Anlage", "Wandbekleidung", "Wandkonstruktion", "Wassertechnische Anlage", "Weitere nutzungsspezifische Anlage"}, selected="Wandbekleidung")
cluster_6 = Cluster_2(category=cluster_5.S_2, chosenitem=list_4, dataid=cluster_5.M_2)

# ----
# Wall_Tile Facade
# Script Reader
panel_16 = Panel("py\wallDefinition3.py")
c__grasshoppername_11 = CSharpScript(inputName=panel_16)  # -> ghParentPath, filePath; inputs inputName: String; same code as c__grasshoppername

# ----
# Script Reader
panel_17 = Panel("py\tileDefinition.py")
# Wall_Normal Facade
panel_18 = Panel("py\wallDefinition3.py")
c__grasshoppername_12 = CSharpScript(inputName=panel_18)  # -> ghParentPath, filePath; inputs inputName: String; same code as c__grasshoppername
c__grasshoppername_13 = CSharpScript(inputName=panel_17)  # -> ghParentPath, filePath; inputs inputName: String; same code as c__grasshoppername
c__grasshoppername_14 = CSharpScript(inputName="py\boardDefinition.py")  # -> ghParentPath, filePath; inputs inputName: String; same code as c__grasshoppername
c__grasshoppername_15 = CSharpScript(inputName="py\structAndFillDefinition.py")  # -> ghParentPath, filePath; inputs inputName: String; same code as c__grasshoppername
c__grasshoppername_16 = CSharpScript(inputName="py\substructionDefinition.py")  # -> ghParentPath, filePath; inputs inputName: String; same code as c__grasshoppername
c__grasshoppername_17 = CSharpScript(inputName="py\paintDefinition.py")  # -> ghParentPath, filePath; inputs inputName: String; same code as c__grasshoppername

# ----
# paint
file_2 = ReadFile(File=c__grasshoppername_17.filePath, PerLineParse=False)

# ----
# Inner Material Setting
# board
file_3 = ReadFile(File=c__grasshoppername_14.filePath, PerLineParse=False)

# ----
# Condition 1:
# Input from rhino
# board
brep = Brep(<brep referenced from the Rhino model>)  # disabled
geofromrh = GhPythonScript(brep=brep)  # -> out, newObj, width, height, depth; inputs brep: Guid; disabled
# ---------- geofromrh: Python ----------
import Rhino
import scriptcontext as sc
import rhinoscriptsyntax as rs
import Grasshopper.Kernel as ghkernel

class ObjFromRH:
    def __init__(self, **kwargs):
        for key, value in kwargs.items():
            setattr(self, key, value)


# Set scriptcontext.doc to Rhino's document to access its objects
sc.doc = Rhino.RhinoDoc.ActiveDoc

def get_attribute(object_id, key=None):
    """
    Get user text from an object by its ID.
    """
    if object_id is None:
        print("No object ID provided.")
        return None

    rhino_object = sc.doc.Objects.Find(object_id)
    if not rhino_object:
        print("Object not found.")
        return None

    if key:
        value = rhino_object.Attributes.GetUserString(key)
        print("User text for key '{}': {}".format(key, value))
        return value
    else:
        all_user_text = rhino_object.Attributes.GetUserStrings()
        objDict = {}
        for k in all_user_text.AllKeys:
            objDict[k] =  all_user_text[k]
        return objDict


if brep == None:
    ghenv.Component.AddRuntimeMessage(ghkernel.GH_RuntimeMessageLevel.Warning, "brep is empty.")
else:
    # To get user text
    obj_dict = get_attribute(brep)
    newObj = ObjFromRH(**obj_dict)
    
    
    width = get_attribute(brep, "breite")
    height = get_attribute(brep, "hoehe")
    depth = get_attribute(brep, "tiefe")
    
    width = width if width != "FALSE" else 1
    height = height if height != "FALSE" else 1
    depth = depth if depth != "FALSE" else 1
    
    width = int(width)
    height = int(height)
    depth = int(depth)
# ---------- end geofromrh ----------
toggle_2 = BooleanToggle(False)  # disabled
toggle_3 = BooleanToggle(False)  # disabled
board_material = GhPythonScript(
    Code=file_3,
    ObjAttr=geofromrh.newObj,
    Width=geofromrh.width,
    Length=geofromrh.height,
    Thickness=geofromrh.depth,
    SearchDB=toggle_2,
    Direction=toggle_3)  # -> Out, Board_obj; disabled

# ----
# Condition 1:
# Input from rhino
# board
brep_2 = Brep(<brep referenced from the Rhino model>)  # disabled
geofromrh_2 = GhPythonScript(brep=brep_2)  # -> out, newObj, width, height, depth; inputs brep: Guid; disabled; same code as geofromrh
toggle_4 = BooleanToggle(False)  # disabled
toggle_5 = BooleanToggle(False)  # disabled
board_material_2 = GhPythonScript(
    Code=file_3,
    ObjAttr=geofromrh_2.newObj,
    Width=geofromrh_2.width,
    Length=geofromrh_2.height,
    Thickness=geofromrh_2.depth,
    SearchDB=toggle_4,
    Direction=toggle_5)  # -> Out, Board_obj; disabled

# ----
# Condition 1:
# Input from rhino
# board
brep_3 = Brep(<brep referenced from the Rhino model>)  # disabled
geofromrh_3 = GhPythonScript(brep=brep_3)  # -> out, newObj, width, height, depth; inputs brep: Guid; disabled; same code as geofromrh
toggle_6 = BooleanToggle(False)  # disabled
toggle_7 = BooleanToggle(False)  # disabled
board_material_3 = GhPythonScript(
    Code=file_3,
    ObjAttr=geofromrh_3.newObj,
    Width=geofromrh_3.width,
    Length=geofromrh_3.height,
    Thickness=geofromrh_3.depth,
    SearchDB=toggle_6,
    Direction=toggle_7)  # -> Out, Board_obj; disabled

# ----
# Condition 1:
# Input from rhino
# board
brep_4 = Brep(<brep referenced from the Rhino model>)  # disabled
geofromrh_4 = GhPythonScript(brep=brep_4)  # -> out, newObj, width, height, depth; inputs brep: Guid; disabled; same code as geofromrh
toggle_8 = BooleanToggle(False)  # disabled
toggle_9 = BooleanToggle(False)  # disabled
board_material_4 = GhPythonScript(
    Code=file_3,
    ObjAttr=geofromrh_4.newObj,
    Width=geofromrh_4.width,
    Length=geofromrh_4.height,
    Thickness=geofromrh_4.depth,
    SearchDB=toggle_8,
    Direction=toggle_9)  # -> Out, Board_obj; disabled

merge_2 = Merge(
    Data1=board_material.Board_obj,
    Data2=board_material_2.Board_obj,
    Data3=board_material_3.Board_obj,
    Data4=board_material_4.Board_obj)  # disabled

# ----
# subStruct + infill
file_4 = ReadFile(File=c__grasshoppername_15.filePath, PerLineParse=False)

# ----
# subStruct
file_5 = ReadFile(File=c__grasshoppername_16.filePath, PerLineParse=False)

data_topic = Data(title)
alldata = Data(data)
objattr = GhPythonScript(
    bauteil_obergruppe="1234",
    material="ThisIsMud",
    breite="65",
    hoehe="250",
    tiefe="5",
    anzahl=Slider(999, range=0..1000),
    url="customized_url heeee")  # -> newObj; inputs anzahl: Int32
# ---------- objattr: Python ----------
import uuid as uu

class customizedObj:
    def __init__(self, **kwargs):
        for key, value in kwargs.items():
            setattr(self, key, value)


variables = {
    'bauteil_obergruppe': bauteil_obergruppe,
    'bauteil_gruner': bauteil_gruner,
    'uuid': uuid,
    'kosten': kosten,
    'zustand': zustand,
    'material': material,
    'ref_gebauede_geschoss': ref_gebauede_geschoss,
    'breite': breite,
    'hoehe': hoehe,
    'tiefe': tiefe,
    'flaeche': flaeche,
    'masse': masse,
    'anzahl': anzahl,
    'foto1': foto1,
    'foto2': foto2,
    'co2': co2,
    'url': url,
}

# Update each variable in the dictionary if it's None
for key in variables:
    if variables[key] is None:
        variables[key] = "unknown"
        if key == 'uuid':
            variables[key] = "customizedObj_" + str(uu.uuid4())



newObj = customizedObj(**variables)
newObj.attrDict = variables
# ---------- end objattr ----------
objattr_2 = GhPythonScript(
    bauteil_obergruppe="1234",
    uuid="customized_uuid heeee",
    breite="65",
    hoehe="250",
    tiefe="5",
    anzahl=Slider(999, range=0..1000))  # -> newObj; inputs anzahl: Int32; same code as objattr
entwine = Entwine(Branch00=cluster_6, FlattenInputs=True)

# ----
# claddingWidth
number_slider_10 = Slider(30, range=0..1000)
int = Integer(number_slider_10)

# ----
# claddingLength
number_slider_11 = Slider(60, range=0..1000)
int_2 = Integer(number_slider_11)

# ----
# kindNum
number_slider_12 = Slider(5, range=0..10)
int_3 = Integer(number_slider_12)

# ----
# wWeight
number_slider_13 = Slider(5, range=2..6)

objattr_3 = GhPythonScript(bauteil_obergruppe="1234", breite="65", hoehe="250", tiefe="1", anzahl=Slider(999, range=0..1000))  # -> newObj; inputs anzahl: Int32; same code as objattr

# ----
# lWeight
number_slider_14 = Slider(4, range=2..6)

# ----
# align point
pt_3 = Point(<point referenced from the Rhino model>)

brep_5 = Brep(<brep referenced from the Rhino model>)
brep_6 = Brep(<brep referenced from the Rhino model>)
brep_7 = Brep(<brep referenced from the Rhino model>)
brep_8 = Brep(<brep referenced from the Rhino model>)
brep_9 = Brep(<brep referenced from the Rhino model>)
brep_10 = Brep(<brep referenced from the Rhino model>)
winfromrh = GhPythonScript(brep=[brep_5, brep_6])  # -> out, newObj, width, height, depth; inputs brep: Guid
# ---------- winfromrh: Python ----------
import Rhino
import scriptcontext as sc
import rhinoscriptsyntax as rs
import Grasshopper.Kernel as ghkernel

class ObjFromRH:
    def __init__(self, **kwargs):
        for key, value in kwargs.items():
            setattr(self, key, value)


# Set scriptcontext.doc to Rhino's document to access its objects
sc.doc = Rhino.RhinoDoc.ActiveDoc

def get_attribute(object_id, key=None):
    """
    Get user text from an object by its ID.
    """
    if object_id is None:
        print("No object ID provided.")
        return None

    rhino_object = sc.doc.Objects.Find(object_id)
    if not rhino_object:
        print("Object not found.")
        return None

    if key:
        value = rhino_object.Attributes.GetUserString(key)
        print("User text for key '{}': {}".format(key, value))
        return value
    else:
        all_user_text = rhino_object.Attributes.GetUserStrings()
        objDict = {}
        for k in all_user_text.AllKeys:
            objDict[k] =  all_user_text[k]
        
        objDict["geo"] = rhino_object.Geometry
        return objDict


if brep == None:
    ghenv.Component.AddRuntimeMessage(ghkernel.GH_RuntimeMessageLevel.Warning, "brep is empty.")
else:
    # To get user text
    obj_dict = get_attribute(brep)
    newObj = ObjFromRH(**obj_dict)
    newObj.attr = obj_dict
    
    
    
    width = get_attribute(brep, "breite")
    height = get_attribute(brep, "hoehe")
    depth = get_attribute(brep, "tiefe")
    
    width = width if width != "FALSE" else 1
    height = height if height != "FALSE" else 1
    depth = depth if depth != "FALSE" else 1
    
    width = int(width)
    height = int(height)
    depth = int(depth)
# ---------- end winfromrh ----------
merge_3 = Merge(Data1=brep_7, Data2=brep_8, Data3=brep_10, Data4=brep_9)

crv_2 = Curve(<curve referenced from the Rhino model>)

brep_11 = Brep(<brep referenced from the Rhino model>)
brep_12 = Brep(<brep referenced from the Rhino model>)
brep_13 = Brep(<brep referenced from the Rhino model>)
brep_14 = Brep(<brep referenced from the Rhino model>)
doorfromrh = GhPythonScript(brep=[brep_11, brep_12])  # -> out, newObj, width, height, depth; inputs brep: Guid
# ---------- doorfromrh: Python ----------
import Rhino
import scriptcontext as sc
import rhinoscriptsyntax as rs
import Grasshopper.Kernel as ghkernel

class ObjFromRH:
    def __init__(self, **kwargs):
        for key, value in kwargs.items():
            setattr(self, key, value)


# Set scriptcontext.doc to Rhino's document to access its objects
sc.doc = Rhino.RhinoDoc.ActiveDoc

def get_attribute(object_id, key=None):
    """
    Get user text from an object by its ID.
    """
    if object_id is None:
        print("No object ID provided.")
        return None

    rhino_object = sc.doc.Objects.Find(object_id)
    if not rhino_object:
        print("Object not found.")
        return None

    if key:
        value = rhino_object.Attributes.GetUserString(key)
        print("User text for key '{}': {}".format(key, value))
        return value
    else:
        all_user_text = rhino_object.Attributes.GetUserStrings()
        objDict = {}
        for k in all_user_text.AllKeys:
            objDict[k] =  all_user_text[k]
        
        objDict["geo"] = rhino_object.Geometry
        return objDict


if brep == None:
    ghenv.Component.AddRuntimeMessage(ghkernel.GH_RuntimeMessageLevel.Warning, "brep is empty.")
else:
    # To get user text
    obj_dict = get_attribute(brep)
    newObj = ObjFromRH(**obj_dict)
    newObj.attr = obj_dict
    
    
    width = get_attribute(brep, "breite")
    height = get_attribute(brep, "hoehe")
    depth = get_attribute(brep, "tiefe")
    
    width = width if width != "FALSE" else 1
    height = height if height != "FALSE" else 1
    depth = depth if depth != "FALSE" else 1
    
    width = int(width)
    height = int(height)
    depth = int(depth)
# ---------- end doorfromrh ----------
merge_4 = Merge(Data1=brep_13, Data2=brep_14)

pt_4 = Point(<point referenced from the Rhino model>)
boundary = BoundarySurfaces(Edges=crv_2)
# Geometry of Opening
brep_15 = Brep(<brep referenced from the Rhino model>)

# ----
# substructThickness
number_slider_15 = Slider(2, range=0..100)

brep_16 = Brep(<brep referenced from the Rhino model>)
brep_17 = Brep(<brep referenced from the Rhino model>)
brep_18 = Brep(<brep referenced from the Rhino model>)
brep_19 = Brep(<brep referenced from the Rhino model>)
brep_20 = Brep(<brep referenced from the Rhino model>)
doorfromrh_2 = GhPythonScript(brep=[brep_16, brep_17, brep_18])  # -> out, newObj, width, height, depth; inputs brep: Guid; same code as doorfromrh
merge_5 = Merge(Data1=brep_19, Data2=brep_20)

# ----
# Cladding Normal Type
brep_21 = Brep(<brep referenced from the Rhino model>)

brep_22 = Brep(<brep referenced from the Rhino model>)
brep_23 = Brep(<brep referenced from the Rhino model>)
brep_24 = Brep(<brep referenced from the Rhino model>)
brep_25 = Brep(<brep referenced from the Rhino model>)
brep_26 = Brep(<brep referenced from the Rhino model>)
brep_27 = Brep(<brep referenced from the Rhino model>)
brep_28 = Brep(<brep referenced from the Rhino model>)
winfromrh_2 = GhPythonScript(brep=[brep_25, brep_27, brep_28, brep_26, brep_21])  # -> out, newObj, width, height, depth; inputs brep: Guid; same code as winfromrh
merge_6 = Merge(Data1=brep_22, Data2=brep_23, Data4=brep_24)

# ----
# substructWidth
number_slider_16 = Slider(4, range=0..100)

crv_3 = Curve(<curve referenced from the Rhino model>)
# Geometry of Opening
brep_29 = Brep(<brep referenced from the Rhino model>)

# ----
# vertiAngle
number_slider_17 = Slider(0, range=0..60)

# ----
# horiAngle
number_slider_18 = Slider(10, range=0..100)

objattr_4 = GhPythonScript(bauteil_obergruppe="1234", breite="65", hoehe="250", tiefe="1", anzahl=Slider(999, range=0..1000))  # -> newObj; inputs anzahl: Int32; same code as objattr

# ----
# vertiOverlap
number_slider_19 = Slider(0, range=0..1000)

# ----
# horiOverlap
number_slider_20 = Slider(1, range=0..10)

boarddb_2 = Data(simplify(boarddb))

# ----
# Mock DataBase
boarddb_3 = BoardDB()  # disabled
tiledb_2 = TileDB()  # disabled
windowdb_2 = Data(windowdb)
doordb_2 = Data(doordb)
data_2 = Data(simplify(boarddb_3))  # disabled
data_3 = Data(simplify(tiledb_2))  # disabled
db_collection = GhPythonScript(windowDB=windowdb_2, doorDB=doordb_2, tileDB=data_3, boardDB=boarddb_2)  # -> out, allDB; inputs windowDB: list, doorDB: list, tileDB: list, boardDB: list
# ---------- db_collection: Python ----------
allDict = {}
allDict["windowDB"] = windowDB
allDict["doorDB"] = doorDB
allDict["tileDB"] = tileDB
allDict["boardDB"] = boardDB

class classForOutput:
    def __init__(self):
        pass

allData = classForOutput()
allData.all_DB = allDict

allDB = allData
# ---------- end db_collection ----------

boundary_2 = BoundarySurfaces(Edges=crv_3)

# ----
# Condition 1:
# Input from rhino
brep_30 = Brep(<brep referenced from the Rhino model>)
geofromrh_5 = GhPythonScript(brep=brep_30)  # -> out, newObj, width, height, depth; inputs brep: Guid; same code as geofromrh
board_material_5 = GhPythonScript(
    objAttr=geofromrh_5.newObj,
    width=geofromrh_5.width,
    length=geofromrh_5.height,
    thickness=geofromrh_5.depth,
    pt=pt_4,
    searchDB=Toggle(False),
    direction=Toggle(True))  # -> out, board_obj; inputs pt: Point3d, searchDB: Boolean, direction: Boolean
# ---------- board_material_5: Python ----------
fileName = "boardDefinition.py"
folderName = "py"

import sys
import os
import Grasshopper

# Access the current Grasshopper document
gh_doc = ghenv.Component.OnPingDocument()

# Get the file path of the current document
file_path = gh_doc.FilePath

# Verify that the document has been saved and file_path is valid
if not file_path:
    raise ValueError("The Grasshopper document needs to be saved to access its path.")

# Construct the path to the external script
script_dir = os.path.dirname(file_path)  # One level up from the file
script_dir = os.path.dirname(script_dir)  # Two levels up from the file
script_path = os.path.join(script_dir, folderName, fileName)  # Path to the script

# Ensure the script directory is in sys.path
script_dir = os.path.dirname(script_path)
if script_dir not in sys.path:
    sys.path.append(script_dir)

# Read and execute the script safely
try:
    with open(script_path, 'r') as file:
        script_content = file.read()
        exec(script_content, globals())
except IOError:
    print("Failed to open or read the script file at {}".format(script_path))
except Exception as e:
    print("Error executing the script: {}".format(e))
# ---------- end board_material_5 ----------

boarddb_4 = Data(simplify(boarddb))

# ----
# Mock DataBase
boarddb_5 = BoardDB()  # disabled
windowdb_3 = Data(windowdb)
doordb_3 = Data(doordb)
tiledb_3 = Data(tilemockdata)
data_4 = Data(simplify(boarddb_5))  # disabled
data_5 = Data(simplify(tiledb_3))
db_collection_2 = GhPythonScript(windowDB=windowdb_3, doorDB=doordb_3, tileDB=data_5, boardDB=boarddb_4)  # -> out, allDB; inputs windowDB: list, doorDB: list, tileDB: list, boardDB: list; same code as db_collection

# ----
# Tile Setting
# Customized Tile Component
number_slider_21 = Slider(100, range=0..100)
customizetile = GhPythonScript(width=Slider(38, range=0..1000), height=Slider(40, range=0..1000), quantity=Slider(70, range=0..100))  # -> out, tile_obj; inputs height: Int32
# ---------- customizetile: Python ----------
fileName = "tileDefinition.py"
folderName = "py"

import sys
import os
import Grasshopper

# Access the current Grasshopper document
gh_doc = ghenv.Component.OnPingDocument()

# Get the file path of the current document
file_path = gh_doc.FilePath

# Verify that the document has been saved and file_path is valid
if not file_path:
    raise ValueError("The Grasshopper document needs to be saved to access its path.")

# Construct the path to the external script
script_dir = os.path.dirname(file_path)  # One level up from the file
script_dir = os.path.dirname(script_dir)  # Two levels up from the file
script_path = os.path.join(script_dir, folderName, fileName)  # Path to the script

# Ensure the script directory is in sys.path
script_dir = os.path.dirname(script_path)
if script_dir not in sys.path:
    sys.path.append(script_dir)

# Read and execute the script safely
try:
    with open(script_path, 'r') as file:
        script_content = file.read()
        exec(script_content, globals())
except IOError:
    print("Failed to open or read the script file at {}".format(script_path))
except Exception as e:
    print("Error executing the script: {}".format(e))
# ---------- end customizetile ----------
customizetile_2 = GhPythonScript(width=Slider(37, range=0..1000), height=Slider(38, range=0..1000), quantity=Slider(90, range=0..100))  # -> out, tile_obj; inputs height: Int32; same code as customizetile
customizetile_3 = GhPythonScript(objAttr=objattr, width=Slider(30, range=0..1000), height=Slider(35, range=0..1000), quantity=number_slider_21)  # -> out, tile_obj; inputs height: Int32; same code as customizetile
customizetile_4 = GhPythonScript(width=Slider(31, range=0..1000), height=Slider(32, range=0..1000), quantity=Slider(60, range=0..100))  # -> out, tile_obj; inputs height: Int32; same code as customizetile
customizetile_5 = GhPythonScript(width=Slider(42, range=0..1000), height=Slider(44, range=0..1000), quantity=Slider(100, range=0..100))  # -> out, tile_obj; inputs height: Int32; same code as customizetile
merge_7 = Merge(
    Data1=customizetile_3.tile_obj,
    Data2=customizetile_4.tile_obj,
    Data3=customizetile.tile_obj,
    Data4=customizetile_5.tile_obj,
    Data5=customizetile_2.tile_obj)

# ----
# Condition 3:
# Search from DB by inputing dimension
# board
toggle_10 = BooleanToggle(True)
board_material_6 = GhPythonScript(width="65", length="250", thickness="1", pt=pt_4, searchDB=toggle_10, direction=Toggle(True))  # -> out, board_obj; inputs pt: Point3d, searchDB: Boolean, direction: Boolean; same code as board_material_5

# ----
# Condition 2:
# Customize by inputing dimension
toggle_11 = BooleanToggle(False)
board_material_7 = GhPythonScript(objAttr=objattr_2, width="65", length="250", thickness="5", pt=pt_4, searchDB=toggle_11, direction=Toggle(True))  # -> out, board_obj; inputs pt: Point3d, searchDB: Boolean, direction: Boolean; same code as board_material_5

# ----
# UI item setting
# Tick the items which you
# want  to show inside UI.
list_5 = ValueList({"bauteil_obergruppe", "bauteil_gruner", "uuid", "kosten", "zustand", "material", "ref_gebauede_geschoss", "breite", "hoehe", "tiefe", "flaeche", "masse", "anzahl"}, selected=["bauteil_obergruppe", "bauteil_gruner", "uuid", "material", "breite", "hoehe", "tiefe", "anzahl"])

python_11 = GhPythonScript(data=entwine)  # -> union, quan; inputs data: tree; same code as python

# ----
# Condition 3:
# Search from DB by inputing dimension
# board
toggle_12 = BooleanToggle(True)
board_material_8 = GhPythonScript(Code=file_3, Width="65", Length="250", Thickness="1", Pt=pt_3, SearchDB=toggle_12, Direction=Toggle(True))  # -> Out, Board_obj

# ----
# Condition 1:
# Input from rhino
# board
brep_31 = Brep(<brep referenced from the Rhino model>)
geofromrh_6 = GhPythonScript(brep=brep_31)  # -> out, newObj, width, height, depth; inputs brep: Guid; same code as geofromrh
board_material_9 = GhPythonScript(
    Code=file_3,
    ObjAttr=geofromrh_6.newObj,
    Width=geofromrh_6.width,
    Length=geofromrh_6.height,
    Thickness=geofromrh_6.depth,
    Pt=pt_3,
    SearchDB=Toggle(False),
    Direction=Toggle(False))  # -> Out, Board_obj

# ----
# thickness
# distance
# direction
toggle_13 = BooleanToggle(True)

# ----
# Sort list by which item,
# Original order if disable.
list_6 = ValueList({"breite", "hoehe", "tiefe", "anzahl"}, selected="anzahl")

# ----
# True: Large -> Small
# False: Small -> Large
toggle_14 = BooleanToggle(True)

# ----
# Condition 2:
# Customize by inputing dimension
# board
toggle_15 = BooleanToggle(False)
board_material_10 = GhPythonScript(
    Code=file_3,
    ObjAttr=objattr_3,
    Width="65",
    Length="250",
    Thickness="1",
    Pt=pt_3,
    SearchDB=toggle_15,
    Direction=Toggle(True))  # -> Out, Board_obj

brep_32 = Brep(merge_4)
data_6 = Data(doorfromrh.newObj)

brep_33 = Brep(merge_3)
data_7 = Data(winfromrh.newObj)

brep_34 = Brep(boundary)
# width
panel_19 = Panel("2")
# width
# thickness
toggle_16 = BooleanToggle(True)
# direction
toggle_17 = BooleanToggle(False)
# thickness
panel_20 = Panel("0.5")

# ----
# Quantity of items matching filters
panel_21 = Panel(python_11.quan)

# ----
# length
panel_22 = Panel("100")
cluster_7 = BranchLook(data=alldata, i=python_11.union)
brep_35 = Brep(boundary_2)

brep_36 = Brep(merge_5)
data_8 = Data(doorfromrh_2.newObj)

brep_37 = Brep(merge_6)
data_9 = Data(winfromrh_2.newObj)

# ----
# subStruct
substruct_infill_material = GhPythonScript(Code=file_5, ObjAttr=objattr_4, Width="3", Thickness="5", Distance="30", Direction=Toggle(False))  # -> Out, Substruct_obj
# subStruct + infill
substruct_infill_material_2 = GhPythonScript(Code=file_4, Width=panel_19, Thickness="5", Distance="50", Direction=toggle_13)  # -> Out, SubstructInfill_obj
# paint
paint_material = GhPythonScript(Code=file_2, Thickness=panel_20)  # -> Out, Paint_obj

# ----
# Cladding Setting
num = Number(number_slider_19)
num_2 = Number(number_slider_20)
num_3 = Number(number_slider_18)
num_4 = Number(number_slider_17)
num_5 = Number(number_slider_16)
num_6 = Number(number_slider_15)

search_tile = GhPythonScript(claddingWidth=int, claddingLength=int_2, kindNum=int_3, wWeight=number_slider_13, lWeight=number_slider_14)  # -> out, searchTileSetting; inputs kindNum: Int32, wWeight: Int32, lWeight: Int32
# ---------- search_tile: Python ----------
allDict = {}
allDict["claddingWidth"] = claddingWidth
allDict["claddingLength"] = claddingLength
allDict["kindNum"] = kindNum
allDict["wWeight"] = wWeight
allDict["lWeight"] = lWeight


class classForOutput:
    def __init__(self):
        pass

allData = classForOutput()
allData.searchTileData = allDict
allData.identity = "searchTile"

searchTileSetting = allData
# ---------- end search_tile ----------
# subStruct
substruct_infill_material_3 = GhPythonScript(Code=file_5, Width="3", Thickness="5", Distance="30", Direction=Toggle(False))  # -> Out, Substruct_obj
# board
board_material_11 = GhPythonScript(Code=file_3, Length=panel_22, Width="300", Thickness="5", Pt=pt_3, SearchDB=toggle_16, Direction=toggle_17)  # -> Out, Board_obj

# ----
# press it when you want to open UI
button_2 = Button()

# ----
# UI Engine
# OpenUI => Opens the Menu Window.
# winHeight => set Height of UI.
# rowNum => set quantity of items in a row.
# ShowItemNum => Specifies the number of items displayed in the Menu.
# Page => Go to specific page
number_slider_22 = Slider(8, range=6..10, expression="x*100")
cluster_8 = Cluster_4(
    openui=button_2,
    winheight=number_slider_22,
    rownum=Slider(4, range=0..10),
    showitemnum=Slider(100, range=0..1000),
    page=Slider(1, range=0..10),
    topic=data_topic,
    chosenitem=list_5,
    data=cluster_7,
    sortitem=list_6,
    sortreverse=toggle_14)  # -> data_5, checkbox_states

merge_8 = Merge(Data1=substruct_infill_material_3.Substruct_obj, Data2=board_material_11.Board_obj)

# ----
# You need to use this component called "trigger" to
# keep updating the output of UI.
trigger = Trigger(Interval=500, TimerInterval=500, Target=cluster_8)  # disabled

entwine_2 = Entwine(
    Branch00=board_material_5.board_obj,
    Branch01=board_material_7.board_obj,
    Branch02=board_material_6.board_obj,
    FlattenInputs=True)  # -> flatten(Result)
merge_9 = Merge(
    Data1=board_material_9.Board_obj,
    Data2=board_material_10.Board_obj,
    Data3=board_material_8.Board_obj,
    Data4=substruct_infill_material.Substruct_obj,
    Data5=substruct_infill_material_2.SubstructInfill_obj,
    Data6=paint_material.Paint_obj)

# ----
# Module Setting
number_slider_23 = Slider(233, range=0..1000)
crv_4 = Curve([<curve referenced from the Rhino model> x3])

# ----
# click this button to
# bake brep
button_3 = Button()

# ----
# Show/Bake in Rhino
number_slider_24 = Slider(23, range=0..100)
show_in_rh = ShowInRh(x=number_slider_24, y=Slider(8, range=0..100), L=cluster_8.data_5, P=graft(cluster_8.checkbox_states))  # -> geo_2, layername_2, text_2, data_2
geo = Geometry(show_in_rh.geo_2)
objattr_5 = ObjAttr(b=button_3, layername=show_in_rh.layername_2, data=show_in_rh.data_2)
item_2 = ListItem(List=show_in_rh.text_2, Index=0, Wrap=True)  # -> Item, Item1
bake = BakeGeometry(Bake=button_3, Geometry=geo, Attributes=objattr_5, DeleteOldBakes=False, PreserveTrees=False)

panel_23 = Panel(show_in_rh.data_2)

# ----
# Module Setting
number_slider_25 = Slider(260, range=0..1000)
number_slider_26 = Slider(30, range=10..30)
crv_5 = Curve([<curve referenced from the Rhino model> x2])

customizetile_6 = Data(merge_7)
searchdbtile = Data(search_tile.searchTileSetting)

brep_38 = Brep(<brep referenced from the Rhino model>)
brep_39 = Brep(<brep referenced from the Rhino model>)

# ----
# When "trigger" is running, this show-text component
# takes a lot of time. Thus, I suggest open it only when
# you want to bake the geometry.
justified_text = JustifiedText3d(
    Location=item_2.Item,
    Text=item_2.Item1,
    Size=1,
    HorizontalAlignment=0,
    VerticalAlginment=0,
    UseMeshes=False,
    Attributes=objattr_5,
    Bake=button_3)

file_6 = ReadFile(File=c__grasshoppername_11.filePath, PerLineParse=False)

# ----
# Cladding Engine
toggle_18 = BooleanToggle(True)
button_4 = Button()
tilefacade = GhPythonScript(
    Code=file_6,
    DB=db_collection_2.allDB,
    CarrierGeo=brep_34,
    WindowGeo=brep_33,
    DoorGeo=brep_32,
    SetTile=customizetile_6,
    CladdingDirection=toggle_18,
    HoriOverlap=num_2,
    VertiOverlap=num,
    HoriAngle=num_3,
    VertiAngle=num_4,
    SubstructWidth=num_5,
    SubstructThickness=num_6,
    Material_collection=entwine_2,
    ModuleCurve=crv_4,
    ModuleCrvDist=Slider(15, range=10..30),
    Init=button_4)  # -> Out, VisualObj, AllTypeMaterialModule, MatRecordObj

file_7 = ReadFile(File=c__grasshoppername_11.filePath, PerLineParse=False)

# ----
# Cladding Engine
normalfacade = Data(merge_8)
toggle_19 = BooleanToggle(False)
button_5 = Button()
normalfacade_2 = GhPythonScript(
    Code=file_7,
    DB=db_collection.allDB,
    CarrierGeo=brep_35,
    WindowGeo=data_9,
    DoorGeo=data_8,
    SetTile=normalfacade,
    CladdingDirection=toggle_19,
    Material_collection=merge_9,
    ModuleCurve=crv_5,
    ModuleCrvDist=number_slider_26,
    Init=button_5)  # -> Out, Ruler, VisualObj, AllTypeMaterialModule, MatRecordObj
panel_24 = Panel(normalfacade_2.Out)

tilefacade_2 = GhPythonScript(
    Code=file_6,
    DB=db_collection_2.allDB,
    CarrierGeo=brep_38,
    WindowGeo=brep_39,
    SetTile=customizetile_6,
    CladdingDirection=Toggle(False),
    HoriOverlap=num_2,
    VertiOverlap=num,
    HoriAngle=num_3,
    VertiAngle=num_4,
    SubstructWidth=num_5,
    SubstructThickness=num_6,
    Material_collection=entwine_2,
    Init=button_4)  # -> Out, VisualObj, WallFrame, WindowForFinalList, DoorForFinalList, AllTypeMaterialModule, MatRecordObj
brep_40 = Brep([<brep referenced from the Rhino model> x2])
brep_41 = Brep(<brep referenced from the Rhino model>)
brep_42 = Brep([<brep referenced from the Rhino model> x4])
normalfacade_3 = GhPythonScript(
    Code=file_7,
    DB=db_collection.allDB,
    CarrierGeo=brep_41,
    WindowGeo=brep_42,
    DoorGeo=brep_40,
    SetTile=normalfacade,
    CladdingDirection=toggle_19,
    Material_collection=merge_9,
    ModuleCurve=crv_5,
    ModuleCrvDist=number_slider_26,
    Init=button_5)  # -> Out, Ruler, VisualObj, AllTypeMaterialModule, MatRecordObj
debrep = DeconstructBrep()  # -> Faces, Edges, Vertices
panel_25 = Panel(tilefacade.Out)
crv_6 = Curve()
crv_7 = Curve([normalfacade_2.Ruler, normalfacade_3.Ruler])
item_3 = ListItem(List=crv_6, Index=0, Wrap=True)
vec = Vector(item_3)

# ----
# Explode wall
number_slider_27 = Slider(0, range=0..100)

# ----
# Explode wall
number_slider_28 = Slider(0, range=0..100)

tilefacadeviewer = TileFacadeViewer(visualobj=[tilefacade.VisualObj, tilefacade_2.VisualObj], N=number_slider_27, openingdist=Slider(0, range=0..100))  # -> movegeo, T, crv_3, geo_5, geo_6, D, door_2, window_2
normfacadeviewer = NormFacadeViewer(relay=[normalfacade_2.VisualObj, normalfacade_3.VisualObj], relay_2=number_slider_28, relay_3=Slider(0, range=0..100))  # -> movegeo, C, crv_3, geo_5, D, door_2, window_2
preview = CustomPreview(Geometry=tilefacadeviewer.geo_6, Material=graft(tilefacadeviewer.D))
previewmat = CustomPreviewMaterials(Geometry=tilefacadeviewer.geo_5, DiffuseColor=RGB(255, 255, 255))
previewmat_2 = CustomPreviewMaterials(Geometry=tilefacadeviewer.movegeo, DiffuseColor=tilefacadeviewer.T)
previewlw_2 = CustomPreviewLineweights(Geometry=tilefacadeviewer.crv_3, Shader=ColourSwatch(SwatchColor=RGB(0, 0, 0)), Absolute=False)
previewlw_3 = CustomPreviewLineweights(
    Geometry=[tilefacadeviewer.door_2, tilefacadeviewer.window_2],
    Shader=ColourSwatch(SwatchColor=RGB(0, 255, 238)),
    Thickness=Slider(4, range=0..10),
    Absolute=False)

# ----
# Module Index
number_slider_29 = Slider(1, range=0..10)

# ----
# Layer Index
number_slider_30 = Slider(0, range=0..10)

# ----
# Module Index
number_slider_31 = Slider(1, range=0..10)

# ----
# Layer Index
number_slider_32 = Slider(4, range=0..10)

preview_2 = CustomPreview(Geometry=normfacadeviewer.geo_5, Material=graft(normfacadeviewer.D))
previewlw_4 = CustomPreviewLineweights(
    Geometry=[normfacadeviewer.door_2, normfacadeviewer.window_2],
    Shader=ColourSwatch(SwatchColor=RGB(0, 255, 238)),
    Thickness=Slider(4, range=0..10),
    Absolute=False)
previewmat_3 = CustomPreviewMaterials(Geometry=normfacadeviewer.movegeo, DiffuseColor=normfacadeviewer.C)
previewlw_5 = CustomPreviewLineweights(Geometry=normfacadeviewer.crv_3, Shader=ColourSwatch(SwatchColor=RGB(0, 0, 0)), Absolute=False)

# ----
# Material Index
number_slider_33 = Slider(0, range=0..10)

# ----
# Module Index
number_slider_34 = Slider(1, range=0..10)

# ----
# Module Visualization
data_10 = Data(simplify(normalfacade_2.AllTypeMaterialModule))
findmodule = GhPythonScript(data=data_10, y=number_slider_29)  # -> out, A; inputs data: tree, y: Int32
# ---------- findmodule: Python ----------
from Grasshopper import DataTree
from Grasshopper.Kernel.Data import GH_Path
from System import Object
import ghpythonlib.treehelpers as th

selected = []
for path in data.Paths:
    if path[1] == y:
        items = data.Branch(path)
        selected.append(items)
    else:
        print("cannot find")

# Output the selected data
A = th.list_to_tree(selected)
# ---------- end findmodule ----------
findlayer = GhPythonScript(data=data_10, y=number_slider_30)  # -> out, A; inputs data: tree, y: Int32
# ---------- findlayer: Python ----------
from Grasshopper import DataTree
from Grasshopper.Kernel.Data import GH_Path
from System import Object
import ghpythonlib.treehelpers as th

selected = []
for path in data.Paths:
    if path[0] == y:
        items = data.Branch(path)
        selected.append(items)
    else:
        print("cannot find")

# Output the selected data
A = th.list_to_tree(selected)
# ---------- end findlayer ----------
cluster_9 = BranchLook(data=findmodule.A, i=number_slider_33)
cluster_10 = BranchLook(data=findlayer.A, i=number_slider_34)

# ----
# Material Index
number_slider_35 = Slider(0, range=0..10)

# ----
# Module Index
number_slider_36 = Slider(0, range=0..10)

# ----
# Module Visualization
data_11 = Data(simplify(tilefacade.AllTypeMaterialModule))
findmodule_2 = GhPythonScript(data=data_11, y=number_slider_31)  # -> out, A; inputs data: tree, y: Int32; same code as findmodule
findlayer_2 = GhPythonScript(data=data_11, y=number_slider_32)  # -> out, A; inputs data: tree, y: Int32; same code as findlayer
cluster_11 = BranchLook(data=findmodule_2.A, i=number_slider_35)
cluster_12 = BranchLook(data=findlayer_2.A, i=number_slider_36)

list_7 = ValueList({"bauteil_obergruppe", "bauteil_gruner", "uuid", "kosten", "zustand", "material", "ref_gebauede_geschoss", "breite", "hoehe", "tiefe", "flaeche", "masse", "anzahl"}, selected=["bauteil_obergruppe", "bauteil_gruner", "uuid", "material", "breite", "hoehe", "tiefe", "anzahl"])
merge_10 = Merge(Data1=tilefacade.MatRecordObj, Data2=tilefacade_2.MatRecordObj, Data3=normalfacade_3.MatRecordObj)
c__grasshoppername_18 = CSharpScript(inputName="py\UI_usedMaterial2.py")  # -> ghParentPath, filePath; inputs inputName: String; same code as c__grasshoppername
list_8 = ValueList({"InnerMaterial": "innerMaterial", "outerMaterial", "Opening": "opening"}, selected="InnerMaterial")
file_8 = ReadFile(File=c__grasshoppername_18.filePath, PerLineParse=False)
chosenitem = Data(list_7)
winheight = Data(Slider(8, range=6..10, expression="x*100"))
openui = Data(Toggle(False))
rownum = Data(Slider(4, range=0..10))
python_12 = GhPythonScript(
    Code=file_8,
    Open=openui,
    ShowType=list_8,
    ShowDes=Toggle(True),
    WinHeight=winheight,
    RowNum=rownum,
    ChosenItem=chosenitem,
    ShowData=merge_10)
panel_26 = Panel(python_12)

# ----
# Filter for Dimension
# This filter module is specifically for content that is 'number.'
# breite [cm]
# hoehe [cm]
# tiefe [cm]
list_9 = ValueList({"breite [cm]": "breite", "hoehe [cm]": "hoehe", "tiefe [cm]": "tiefe"}, selected="breite [cm]")  # disabled
cluster_13 = Cluster_3(S=title, M=list_9, data=data)  # -> S_2, M_2, S_3; disabled
number_slider_37 = Slider(209, range=0..1000)  # disabled
number_slider_38 = Slider(5, range=0..1000)  # disabled

# ----
# Here is the range for the item you selected.
panel_27 = Panel(cluster_13.S_3)  # disabled

# ----
# You can input minimum and maximum numbers (minNum and maxNum)
#  to find items within the domain.
# Alternatively, you can leave either minNum or maxNum blank.
number_filter = GhPythonScript(Category=cluster_13.S_2)  # -> out, chosenItem; inputs Category: list; disabled
# ---------- number_filter: Python ----------
"""
This component is used for finding item that within minNum and maxNum.
If the item is "FALSE" or the one that can't transfer to float, this item will still be output.
"""
import Grasshopper.Kernel as ghkernel
import math

if len(Category) == 0:
    ghenv.Component.AddRuntimeMessage(ghkernel.GH_RuntimeMessageLevel.Warning, "Category is empty.")

else:
    if minNum is None:
        minNum = float('-inf')
    if maxNum is None:
        maxNum = float('inf')
    
    if minNum > maxNum:
        ghenv.Component.AddRuntimeMessage(ghkernel.GH_RuntimeMessageLevel.Warning, "minNum should smaller than or equal to maxNum.")
    
    matchedItem = []
    for item in Category:
        try:
            float_item = float(item)
            if float_item>=minNum and float_item<=maxNum:
                matchedItem.append(item)
        except:
            matchedItem.append(item)
            
    if len(matchedItem) == 0:
        ghenv.Component.AddRuntimeMessage(ghkernel.GH_RuntimeMessageLevel.Warning, "Nothing matches filter.")

    chosenItem = matchedItem
# ---------- end number_filter ----------

cluster_14 = Cluster_2(category=cluster_13.S_2, chosenitem=number_filter.chosenItem, dataid=cluster_13.M_2)  # disabled

# ----
# Filter for Quantity
# This filter module is specifically for content that is 'number.'
list_10 = ValueList({"anzahl"}, selected="anzahl")  # disabled
panel_28 = Panel("anzahl")  # disabled
cluster_15 = Cluster_3(S=title, M=list_10, data=data)  # -> S_2, M_2, S_3; disabled
number_slider_39 = Slider(100, range=0..1000)  # disabled
number_slider_40 = Slider(5, range=0..1000)  # disabled

# ----
# Here is the range for the item you selected.
panel_29 = Panel(cluster_15.S_3)  # disabled

# ----
# You can input minimum and maximum numbers (minNum and maxNum)
#  to find items within the domain.
# Alternatively, you can leave either minNum or maxNum blank.
number_filter_2 = GhPythonScript(Category=cluster_15.S_2)  # -> out, chosenItem; inputs Category: list; disabled; same code as number_filter

cluster_16 = Cluster_2(category=cluster_15.S_2, chosenitem=number_filter_2.chosenItem, dataid=cluster_15.M_2)  # disabled

# ==== cluster BranchLook: To see the condition of branch data.
data = ClusterInput()
data_2 = Data(data)
tstat = TreeStatistics(Tree=data_2)  # -> Paths, Length, Count
i = ClusterInput()
item = ListItem(List=tstat.Paths, Index=i, Wrap=True)
branch = TreeBranch(Tree=data_2, Path=item, MaintainPaths=True)
B = ClusterOutput(branch)

# ==== cluster BoardDB
series = Series(Start=0, Step=1, Count="3")
item = ListItem(List=series, Index=0, Wrap=True)  # -> Item, Item1, Item2
number_slider = Slider(700, range=0..1000)
dom = ConstructDomain(DomainStart=Slider(40, range=0..1000), DomainEnd=Slider(100, range=0..1000))
dom_2 = ConstructDomain(DomainStart=Slider(50, range=0..1000), DomainEnd=Slider(300, range=0..10000))
dom_3 = ConstructDomain(DomainStart=Slider(116, range=0..300), DomainEnd=Slider(177, range=0..300))
dom_4 = ConstructDomain(DomainStart=Slider(2, range=0..1000), DomainEnd=Slider(4, range=0..10000))
# width
random = Random(Range=dom, Number=number_slider, Seed=item.Item, Integers=True)
# length
random_2 = Random(Range=dom_2, Number=number_slider, Seed=item.Item1, Integers=True)
# quantity
random_3 = Random(Range=dom_3, Number=number_slider, Seed=item.Item2, Integers=True)
random_4 = Random(Range=dom_4, Number=number_slider, Seed=item.Item1, Integers=True)
repeat = RepeatData(Data="uuid_DB_", Length=number_slider)  # -> simplify(graft(Data))
series_2 = Series(Start=0, Step=1, Count=number_slider)  # -> simplify(graft(Series))
repeat_2 = RepeatData(Data="bauteil_obergruppe", Length=number_slider)  # -> simplify(graft(Data))
repeat_3 = RepeatData(Data="bauteil_gruner", Length=number_slider)  # -> simplify(graft(Data))
series_3 = Series(Start=0, Step=1, Count=number_slider)  # -> simplify(graft(Series))
series_4 = Series(Start=0, Step=1, Count=number_slider)  # -> simplify(graft(Series))
graft = GraftTree(Tree=random_3, IncludeEmptyLists=True, IncludeNullItems=True)
merge = Merge(Data1=repeat, Data2=series_2)
merge_2 = Merge(Data1=repeat_2, Data2=series_3)
merge_3 = Merge(Data1=repeat_3, Data2=series_4)
graft_2 = GraftTree(Tree=random, IncludeEmptyLists=True, IncludeNullItems=True)
graft_3 = GraftTree(Tree=random_2, IncludeEmptyLists=True, IncludeNullItems=True)
graft_4 = GraftTree(Tree=random_4, IncludeEmptyLists=True, IncludeNullItems=True)
join = TextJoin(Text=merge)
join_2 = TextJoin(Text=merge_2)
join_3 = TextJoin(Text=merge_3)
rectangle = Rectangle(Plane=PlaneXY(0, 0, 0), XSize=random, YSize=random_2, Radius=0)  # -> simplify(graft(Rectangle)), Length
area = Area(Geometry=flatten(rectangle.Rectangle))  # -> Area, Centroid; disabled
objattr = GhPythonScript(bauteil_obergruppe=join_2, bauteil_gruner=join_3, uuid=join, breite=graft_2, hoehe=graft_3, tiefe=graft_4, anzahl=graft)  # -> flatten(newObj); inputs anzahl: Int32
# ---------- objattr: Python ----------
class ObjFromRH:
    def __init__(self, **kwargs):
        for key, value in kwargs.items():
            setattr(self, key, value)

variables = {
    'bauteil_obergruppe': bauteil_obergruppe,
    'bauteil_gruner': bauteil_gruner,
    'uuid': uuid,
    'kosten': kosten,
    'zustand': zustand,
    'material': material,
    'ref_gebauede_geschoss': ref_gebauede_geschoss,
    'breite': breite,
    'hoehe': hoehe,
    'tiefe': tiefe,
    'flaeche': flaeche,
    'masse': masse,
    'anzahl': anzahl,
    'foto1': foto1,
    'foto2': foto2,
    'co2': co2,
    'url': url,
}

# Update each variable in the dictionary if it's None
for key in variables:
    if variables[key] is None:
        variables[key] = "unknown"



newObj = ObjFromRH(**variables)
# ---------- end objattr ----------
sort = SortList(Keys=area.Area, ValuesA=flatten(rectangle.Rectangle))  # -> Keys, ValuesA; disabled
python = GhPythonScript(
    identity="board",
    geometry=rectangle.Rectangle,
    quantity=graft,
    name=join_2,
    width=graft_2,
    height=graft_3,
    depth=graft_4)  # -> out, objList; inputs geometry: tree of Rectangle3d, quantity: tree of Int32, name: tree, width: tree, height: tree, depth: tree; disabled
# ---------- python: Python ----------
class BuildingComponent:
    def __init__(self, identity, geometry, quantity, name, width, height, depth):
        self.identity = identity
        self.geometry = geometry
        self.quantity = quantity
        self.name = name
        self.width = width
        self.height = height
        self.depth = depth

objList = []
for geo, qua, na, wi, he, de in zip(geometry.Branches, quantity.Branches, name.Branches, width.Branches, height.Branches, depth.Branches):
    obj = BuildingComponent(identity, geo[0], qua[0], na[0], wi[0], he[0], de[0])
    objList.append(obj)
# ---------- end python ----------
item_2 = ListItem(List=sort.ValuesA, Index=0, Wrap=True)  # disabled
newobj = ClusterOutput(objattr)

# ==== cluster TileDB
number_slider = Slider(200, range=0..1000)
series = Series(Start=0, Step=1, Count="3")
item = ListItem(List=series, Index=0, Wrap=True)  # -> Item, Item1, Item2
dom = ConstructDomain(DomainStart=Slider(10, range=0..10), DomainEnd=Slider(60, range=0..100))
dom_2 = ConstructDomain(DomainStart=Slider(10, range=0..10), DomainEnd=Slider(1120, range=0..10000))
dom_3 = ConstructDomain(DomainStart=Slider(191, range=0..300), DomainEnd=Slider(262, range=0..300))
# width
random = Random(Range=dom, Number=number_slider, Seed=item.Item, Integers=True)
# length
random_2 = Random(Range=dom_2, Number=number_slider, Seed=item.Item1, Integers=True)
# quantity
random_3 = Random(Range=dom_3, Number=number_slider, Seed=item.Item2, Integers=True)
rectangle = Rectangle(Plane=PlaneXY(0, 0, 0), XSize=random, YSize=random_2, Radius=0)  # -> simplify(graft(Rectangle)), Length
graft = GraftTree(Tree=random_3, IncludeEmptyLists=True, IncludeNullItems=True)
repeat = RepeatData(Data="tileName_", Length=number_slider)  # -> simplify(graft(Data))
series_2 = Series(Start=0, Step=1, Count=number_slider)  # -> simplify(graft(Series))
merge = Merge(Data1=repeat, Data2=series_2)
join = TextJoin(Text=merge)
python = GhPythonScript(identity="tile", geometry=rectangle.Rectangle, quantity=graft, name=join)  # -> out, objList; inputs geometry: tree of Rectangle3d, quantity: tree of Int32, name: tree
# ---------- python: Python ----------
class BuildingComponent:
    def __init__(self, identity, geometry, quantity, name):
        self.identity = identity
        self.geometry = geometry
        self.quantity = quantity
        self.name = name

objList = []
for geo, qua, na in zip(geometry.Branches, quantity.Branches, name.Branches):
    obj = BuildingComponent(identity, geo[0], qua[0], na[0])
    objList.append(obj)
# ---------- end python ----------
objlist = ClusterOutput(python.objList)

# ==== cluster Cluster
S = ClusterInput()
M = ClusterInput()
data = ClusterInput()
mindex = MemberIndex(Set=S, Member=M)  # -> Index, Count
data_2 = Data(data)
item = ListItem(List=data_2, Index=mindex.Index, Wrap=True)
cset = CreateSet(List=flatten(item))  # -> Set, Map
lng = ListLength(List=cset.Set)
S_2 = ClusterOutput(cset.Set)
M_2 = ClusterOutput(cset.Map)
L = ClusterOutput(lng)

# ==== cluster Cluster_2
category = ClusterInput()
chosenitem = ClusterInput()
dataid = ClusterInput()
category_2 = Data(category)
chosenitem_2 = Data(chosenitem)
dataid_2 = Data(dataid)
null = NullItem(Item=chosenitem_2)  # -> flatten(NullFlags), InvalidFlags, Description
item = ListItem(List=null.NullFlags, Index=0, Wrap=True)
filter = StreamFilter(Gate=item, Stream0=chosenitem_2, Stream1=category_2)
mindex = MemberIndex(Set=category_2, Member=filter)  # -> flatten(Index), Count
python = GhPythonScript(choose=mindex.Index, data=dataid_2)  # -> out, a; inputs choose: list, data: list
# ---------- python: Python ----------
a = []
for id, d in enumerate(data):
    if d in choose:
        a.append(id)
# ---------- end python ----------
a = ClusterOutput(python.a)

# ==== cluster Cluster_3
S = ClusterInput()
M = ClusterInput()
data = ClusterInput()
mindex = MemberIndex(Set=S, Member=M)  # -> Index, Count
data_2 = Data(data)
item = ListItem(List=data_2, Index=mindex.Index, Wrap=True)
cset = CreateSet(List=flatten(item))  # -> Set, Map
bnd = Bounds(Numbers=cset.Map)
dedomain = DeconstructDomain(Domain=bnd)  # -> Start, End
S_2 = ClusterOutput(cset.Set)
M_2 = ClusterOutput(cset.Map)
S_3 = ClusterOutput([dedomain.Start, dedomain.End])

# ==== cluster ChangeImgPath
relay = ClusterInput()
panel = Panel("""13
14""")
parent_folder = ClusterInput()
item = ListItem(List=relay, Index=panel, Wrap=True)

# ----
# alter img
python = GhPythonScript(parent_folder=parent_folder, picture_path=item)  # -> out, found_path_list; inputs picture_path: tree
# ---------- python: Python ----------
import os
import ghpythonlib.treehelpers as th

def build_file_map(parent_folder):
    file_map = {}
    for root, dirs, files in os.walk(parent_folder):
        for file in files:
            if file not in file_map:  # This check adds the first found instance if multiple files with the same name exist
                file_map[file] = os.path.join(root, file)
    return file_map

def find_picture(file_map, picture_name):
    return file_map.get(picture_name, None)

# Assuming 'parent_folder' and 'picture_path' are defined
file_map = build_file_map(parent_folder)

total_found = 0
total_not_found = 0

found_path_list = []
for pic_path in picture_path.Branches:
    temp = []
    for pic in pic_path:
        file_name = os.path.basename(pic)
        found_path = find_picture(file_map, file_name)
        if found_path:
            total_found += 1
            temp.append(found_path)
        else:
            total_not_found += 1
            temp.append(os.path.join(parent_folder, "notFound.jpg"))
    found_path_list.append(temp)

found_path_list = th.list_to_tree(found_path_list)
print("found img: %d" % (total_found))
print("not found img: %d" % (total_not_found))
# ---------- end python ----------

panel_2 = Panel("""16
2""")
replace = ReplaceItems(List=relay, Item=python.found_path_list, Indices=panel, Wrap=False)
item_2 = ListItem(List=replace, Index=panel_2, Wrap=True)

# ----
# alter url
python_2 = GhPythonScript(data=item_2)  # -> out, simplify(graft(urlList)); inputs data: tree
# ---------- python_2: Python ----------
import ghpythonlib.treehelpers as th
urlList = []
for d in data.Branches:
    bautStr = d[0]
    if bautStr.find(","):
        print("heee")
        print(bautStr)
    alterStr = str(d[0]).replace(" ", "_")
    urlString = "https://bfhreuse24.site/shop/" + alterStr + "/" + str(d[1])
    url = urlString 
    urlList.append(url)

urlList = th.list_to_tree(urlList)
# ---------- end python_2 ----------

replace_2 = ReplaceItems(List=replace, Item=python_2.urlList, Indices="16", Wrap=False)
L = ClusterOutput(replace_2)

# ==== cluster ShowInRh
L = ClusterInput()
P = ClusterInput()
dispatch = Dispatch(List=L, DispatchPattern=P)  # -> ListA, ListB
clean = CleanTree(RemoveNulls=True, RemoveInvalid=True, RemoveEmpty=invert(False), Tree=dispatch.ListA)
panel = Panel("""bauteil_obergruppe
bauteil_gruner
uuid
kosten
zustand
material
ref_ge_gebauede_geschoss
breite
hoehe
tiefe
flaeche
masse
anzahl
foto1
foto2
co2
url""")
panel_2 = Panel("""7
8
9""")
item = ListItem(List=clean, Index=panel_2, Wrap=True)
item_2 = ListItem(List=clean, Index="12", Wrap=True)
x = ClusterInput()
y = ClusterInput()
number_slider = Slider(10, range=0..10)
number_slider_2 = Slider(23, range=0..100)
alterfalse = GhPythonScript(data=item)  # -> a; inputs data: tree
# ---------- alterfalse: Python ----------
import ghpythonlib.treehelpers as th
o = []
for dd in data.Branches:
    temp = []
    for d in dd:
        if d == 0:
            d = 1
        temp.append(d)
    o.append(temp)

a = th.list_to_tree(o)
# ---------- end alterfalse ----------
y_2 = Data(y)
x_2 = Data(x)
item_3 = ListItem(List=alterfalse, Index=0, Wrap=True)  # -> Item, Item1, Item2
rectangle = Rectangle(Plane=PlaneXY(0, 0, 0), XSize=item_3.Item, YSize=item_3.Item1, Radius=0)  # -> Rectangle, Length
ma = MassAddition(Input=flatten(item_3.Item))  # -> Result, PartialResults
panel_3 = Panel(ma.PartialResults)
boundary = BoundarySurfaces(Edges=rectangle.Rectangle)
Z = UnitZ(Factor=item_3.Item2)
addition = Addition(A=item_3.Item1, B=y_2)
extr = Extrude(Base=boundary, Direction=Z)
python = GhPythonScript(x=ma.PartialResults, y=x_2)  # -> a; inputs x: list
# ---------- python: Python ----------
x = [i + y * (id+1) for id, i in enumerate(x)]
x.insert(0,0)
a = x[:-1]
# ---------- end python ----------
series = Series(Start=0, Step=addition, Count=item_2)
panel_4 = Panel(python)

panel_5 = Panel("""bauteil_gruner
uuid
material""")
panel_6 = Panel("""1
2
5""")

X = UnitX(Factor=python)
item_4 = ListItem(List=clean, Index=panel_6, Wrap=True)
item_5 = ListItem(List=clean, Index=0, Wrap=True)  # -> Item, Item1
move = Move(Geometry=extr, Motion=graft(X))  # -> Geometry, Transform
Y = UnitY(Factor=series)
xy = XYPlane(Origin=Point(0, 0, 0))
python_2 = GhPythonScript(data=item_4, name=panel_5)  # -> out, simplify(treeContainer); inputs data: tree, name: list
# ---------- python_2: Python ----------
from Grasshopper.Kernel.Data import GH_Path
import System.Array as array
from Grasshopper import DataTree

treeContainer = DataTree[object]()

for id, d in enumerate(data.Branches):
    new_d = ""
    for n, info in zip(name, d):
        st = " : ".join((n, info)) + "\n"
        new_d += st
    path = data.Paths[id]
    treeContainer.AddRange([new_d], path)
# ---------- end python_2 ----------
pt = Point(xy)
join = TextJoin(Text=[item_5.Item, item_5.Item1], Join=" _ ")
move_2 = Move(Geometry=move.Geometry, Motion=Y)  # -> Geometry, Transform
move_3 = Move(Geometry=pt, Motion=graft(X))  # -> Geometry, Transform
Y_2 = UnitY(Factor=expr("-x", Slider(4, range=0..10)))
move_4 = Move(Geometry=move_3.Geometry, Motion=Y_2)  # -> simplify(Geometry), Transform
tstat = TreeStatistics(Tree=move_4.Geometry)  # -> Paths, Length, Count
tstat_2 = TreeStatistics(Tree=python_2.treeContainer)  # -> Paths, Length, Count
panel_7 = Panel(move_4.Geometry)
replace = ReplacePaths(Data=python_2.treeContainer, Search=tstat_2.Paths, Replace=tstat.Paths)
merge = Merge(Data1=move_4.Geometry, Data2=replace)
layername = Data(join)
text = Data(merge)
data = Data(clean)
geo = Geometry(move_2.Geometry)
text_2 = ClusterOutput(text)
data_2 = ClusterOutput(data)
geo_2 = ClusterOutput(geo)
layername_2 = ClusterOutput(layername)

# ==== cluster ObjAttr
layername = ClusterInput()
data = ClusterInput()
layername_2 = Data(layername)
data_2 = Data(data)
b = ClusterInput()
emptyreplace = GhPythonScript(x=data_2)  # -> a; inputs x: tree
# ---------- emptyreplace: Python ----------
import ghpythonlib.treehelpers as th

a = []
for b in x.Branches:
    t = []
    for i in b:
        if i == "":
            t.append("FALSE")
        else:
            t.append(i)
    a.append(t)

a = th.list_to_tree(a)
# ---------- end emptyreplace ----------
ghpython_script = GhPythonScript(b=b, data=layername_2)  # -> oData; inputs b: Boolean, data: tree
# ---------- ghpython_script: Python ----------
if b:
    oData = data
# ---------- end ghpython_script ----------
panel = Panel("""bauteil_obergruppe
bauteil_gruner
uuid
kosten
zustand
material
ref_gebauede_geschoss
breite
hoehe
tiefe
flaeche
masse
anzahl
foto1
foto2
co2
url""")
create_modify_layers = CreateModifyLayers(LayerName=ghpython_script, DeleteLayer=False, enableFullPath=True)  # -> LayerNames, LayerFullPath
createattributes = CreateAttributes(
    Name=create_modify_layers.LayerNames,
    LayerName=create_modify_layers.LayerNames,
    UserDataKeys=panel,
    UserDataValues=emptyreplace,
    enableFullPath=False)
object_attributes = ClusterOutput(createattributes)

# ==== cluster Cluster_4
showitemnum = ClusterInput()
page = ClusterInput()
sortreverse = ClusterInput()
chosenitem = ClusterInput()
sortitem = ClusterInput()
winheight = ClusterInput()
topic = ClusterInput()
data = ClusterInput()
openui = ClusterInput()
rownum = ClusterInput()
showitemnum_2 = Data(showitemnum)
sortreverse_2 = Data(sortreverse)
chosenitem_2 = Data(chosenitem)
page_2 = Data(page)
sortitem_2 = Data(sortitem)
winheight_2 = Data(winheight)
topic_2 = Data(topic)
data_2 = Data(data)
openui_2 = Data(openui)
rownum_2 = Data(rownum)
item = ListItem(List=flatten(sortitem_2), Index=0, Wrap=True)
mindex = MemberIndex(Set=topic_2, Member=item)  # -> flatten(Index), Count
null = NullItem(Item=item)  # -> NullFlags, InvalidFlags, Description
python = GhPythonScript(Data=data_2, item=mindex.Index, sortReverse=sortreverse_2)  # -> out, sorted_branches; inputs Data: tree, sortReverse: Boolean
# ---------- python: Python ----------
import ghpythonlib.treehelpers as th

def sort_branches_by_item(branches, index, reverseBool):
    
    branches_with_false = []
    other_branches = []
    for branch in branches:
        try:
            floatItem = float(branch[index])
            other_branches.append(branch)
        except:
            branches_with_false.append(branch)
    
    # Sort the valid branches based on the item at the specified index
    sorted_other_branches = sorted(other_branches, key=lambda branch: float(branch[index]), reverse=reverseBool)
    
    # Append the branches with False at the end
    sorted_branches = sorted_other_branches + branches_with_false
    
    return sorted_branches

# Example usage
branches = [list(b) for b in Data.Branches]
sorted_branches = sort_branches_by_item(branches, item, sortReverse)
sorted_branches = th.list_to_tree(sorted_branches)
# ---------- end python ----------
filter = StreamFilter(Gate=null.NullFlags, Stream0=python.sorted_branches, Stream1=data_2)
data_3 = Data(filter)
null_2 = NullItem(Item=chosenitem_2)  # -> flatten(NullFlags), InvalidFlags, Description
item_2 = ListItem(List=null_2.NullFlags, Index=0, Wrap=True)
filter_2 = StreamFilter(Gate=item_2, Stream0=chosenitem_2, Stream1=topic_2)

# ----
# search Image & url path
panel = Panel("foto1")
mindex_2 = MemberIndex(Set=topic_2, Member="foto2")  # -> flatten(Index), Count
mindex_3 = MemberIndex(Set=topic_2, Member=panel)  # -> flatten(Index), Count
item_3 = ListItem(List=data_3, Index=mindex_2.Index, Wrap=True)
item_4 = ListItem(List=data_3, Index=mindex_3.Index, Wrap=True)
merge = Merge(Data1=item_4, Data2=item_3)

mindex_4 = MemberIndex(Set=topic_2, Member=filter_2)  # -> flatten(Index), Count
tstat = TreeStatistics(Tree=data_3)  # -> Paths, Length, Count
item_5 = ListItem(List=data_3, Index=mindex_4.Index, Wrap=True)
dup = DuplicateData(Data=filter_2, Number=tstat.Count, Order=True)
unflatten = UnflattenTree(Tree=dup, Guide=item_5)
graft = GraftTree(Tree=item_5, IncludeEmptyLists=True, IncludeNullItems=True)
graft_2 = GraftTree(Tree=unflatten, IncludeEmptyLists=True, IncludeNullItems=True)
merge_2 = Merge(Data1=graft_2, Data2=graft)
join = TextJoin(Text=merge_2, Join=": ")
pshift = ShiftPaths(Data=join, Offset=-1)
tstat_2 = TreeStatistics(Tree=pshift)  # -> Paths, Length, Count
series = Series(Start=0, Step=1, Count=tstat_2.Count)
partition = PartitionList(List=series, Size=showitemnum_2)
tstat_3 = TreeStatistics(Tree=partition)  # -> Paths, Length, expr("x-1", Count)
min = Minimum(A=page_2, B=tstat_3.Count)
cluster = BranchLook(data=partition, i=min)
cluster_2 = BranchLook(data=data_3, i=cluster)
cluster_3 = BranchLook(data=pshift, i=cluster)
cluster_4 = BranchLook(data=merge, i=cluster)
item_6 = ListItem(List=cluster_2, Index="16", Wrap=True)
c__grasshoppername = CSharpScript(inputName="py\UI_usedMaterial.py")  # -> ghParentPath, filePath; inputs inputName: String
# ---------- c__grasshoppername: C# usings ----------
using System.IO;
# ---------- c__grasshoppername: C# ----------
    if(this.GrasshopperDocument.IsFilePathDefined)
    {
      string p = this.GrasshopperDocument.FilePath;
      DirectoryInfo directoryInfo = new DirectoryInfo(p);
      string parentFolderPath = directoryInfo.Parent.Parent.FullName;

      string filePath_ = string.Format("{0}\\{1}", parentFolderPath, inputName);

      ghParentPath = parentFolderPath;
      filePath = filePath_;

    }
# ---------- end c__grasshoppername ----------
item_7 = ListItem(List=cluster_4, Index=0, Wrap=True)
python_2 = GhPythonScript(
    open=Button(),
    showNum=showitemnum_2,
    winHeight=winheight_2,
    rowNum=rownum_2,
    imagePaths=item_7,
    urlList=item_6,
    data=cluster_3)  # -> out, selectedIndices, graft(checkbox_states); inputs open: Boolean, showNum: Int32, rowNum: Int32, imagePaths: tree, urlList: tree, data: tree
# ---------- python_2: Python ----------
import Rhino
import Eto.Forms as forms
import Eto.Drawing as drawing
import webbrowser
import scriptcontext as sc

if winHeight is None:
    winHeight = 800
if rowNum is None:
    rowNum = 4

def create_label_with_font(text, font_size, font_family="Arial"):
    label = forms.Label(Text=text)
    label.Font = drawing.Font(font_family, font_size)
    return label

# Assume 'selectedIndices' is a global list defined outside this class 
# to store the indices of selected items. This is a simplification for demonstration.

selectedIndices = []  # This will be used to store the indices of selected items.
selectedBool = []

class TestWindow(forms.Form):  # Use Dialog[bool] for a modal dialog
    def __init__(self):
        super(TestWindow, self).__init__()
        self.Title = "Image Viewer"
#        self.MinimumSize = drawing.Size(100, 50)
        
        self.Location = drawing.Point(100, 100)


        self.checkBoxes = []

        self.layout = forms.DynamicLayout()
        self.layout.Height = winHeight

        self.scrollable = forms.Scrollable()
        self.imageLayout = forms.DynamicLayout()
        self.imageLayout.Padding = drawing.Padding(0, 10, 10, 60)
        self.scrollable.Content = self.imageLayout
        self.layout.AddRow(self.scrollable)

        self.Content = self.layout

        self.imagePaths = imagePaths
        self.urlList = urlList
        self.dataList = dataList
        self.populate_images()


    def populate_images(self):
        images_per_row = rowNum
        row = []
        count = 0
        
        for path, data, urrl in zip(self.imagePaths, self.dataList, self.urlList):
            try:
                unitLayout = forms.StackLayout()
                unitLayout.Orientation = forms.Orientation.Vertical
                unitLayout.Spacing = 5
                unitLayout.Padding = drawing.Padding(10)
    
                image = drawing.Bitmap(path)
                imageView = forms.ImageView()
                imageView.Image = image
                imageView.Size = drawing.Size(250, 250)  # Fixed size for the image
    
                # Create a horizontal StackLayout for descriptions
                descriptionsLayout = forms.StackLayout()
                descriptionsLayout.Spacing = 3
                
                descriptions = data
                
                desired_font_size = 10
                
                for desc in descriptions:
                    # Create and add labels with the desired font size to the layout.
                    descriptionsLayout.Items.Add(create_label_with_font(desc, desired_font_size))
                
                # Encapsulate descriptionsLayout in a Scrollable for horizontal scrolling
                descriptionScrollable = forms.Scrollable()
                descriptionScrollable.Content = descriptionsLayout
                
                # Set the size of the Scrollable to match the imageView's size
                # Here, the height is arbitrary since it's a horizontal scroll
                descriptionScrollable.Width = imageView.Width
                
                link_button = forms.LinkButton(Text="Open Website")
                link_button.Click += lambda sender, e, url=urrl: webbrowser.open(url)
                
                
                # Checkbox and Label Pair
                checkBoxLabelLayout = forms.StackLayout()  # Horizontal layout for checkbox and label
                checkBoxLabelLayout.Orientation = forms.Orientation.Horizontal
                checkBoxLabelLayout.Spacing = 5
                
                checkBox = forms.CheckBox() #####################################
                checkBox.CheckedChanged += self.on_checked_changed
                self.checkBoxes.append(checkBox)
                
                checkBoxLabel = forms.Label(Text="Show in Rhino")  # Custom font label
                checkBoxLabel.Font = drawing.Font("Arial Bold", 13)  # Set the font here
                
                checkBoxLabelLayout.Items.Add(checkBox)
                checkBoxLabelLayout.Items.Add(checkBoxLabel)
                
                
                # Add the imageView, descriptionScrollable, and checkBox to the unitLayout
                unitLayout.Items.Add(imageView)
                unitLayout.Items.Add(descriptionScrollable)  # Add the scrollable descriptions
                unitLayout.Items.Add(link_button)
                unitLayout.Items.Add(checkBoxLabelLayout)
    
                row.append(unitLayout)
    
                count += 1
                if count == images_per_row:
                    self.imageLayout.AddRow(*row)
                    row = []
                    count = 0
    
            except Exception as e:
                forms.MessageBox.Show("Failed to load image: " + str(e))
    
        if row:
            self.imageLayout.AddRow(*row)
    
    
    def on_checked_changed(self, sender, e):
        # Update the stored state when a checkbox is changed
        states = [checkBox.Checked for checkBox in self.checkBoxes]
        sc.sticky['checkbox_states'] = states



imagePaths = [image[0] for image in imagePaths.Branches]
urlList = [urll[0] for urll in urlList.Branches]
dataList = [d for d in data.Branches]


def show_check_box_form():
    form = TestWindow()
    form.Show()

# A simple function to simulate a value listener that polls for checkbox state changes
def poll_checkbox_states():
    # Default to all False if not set
    return sc.sticky.get('checkbox_states', [False] * showNum)

# This would be your Grasshopper component's main run function
# Use a timer to periodically trigger this function
checkbox_states = poll_checkbox_states()


# Assuming 'showForm' is a boolean input to trigger the form display
if open:
    sc.sticky['checkbox_states'] = [False] * showNum
    show_check_box_form()
# ---------- end python_2 ----------
python_3 = GhPythonScript(
    open=openui_2,
    showNum=showitemnum_2,
    winHeight=winheight_2,
    rowNum=rownum_2,
    imagePaths=item_7,
    urlList=item_6,
    data=cluster_3)  # -> out, selectedIndices, graft(checkbox_states); inputs open: Boolean, showNum: Int32, rowNum: Int32, imagePaths: tree, urlList: tree, data: tree; same code as python_2
data_4 = Data(cluster_2)
checkbox_states = ClusterOutput(python_3.checkbox_states)
data_5 = ClusterOutput(data_4)

# ==== cluster Cluster_5

# ----
# Title List
panel = Panel("""bauteil_obergruppe
bauteil_gruner
uuid
kosten
zustand
material
ref_gebauede_geschoss
breite
hoehe
tiefe
flaeche
masse
anzahl
foto1
foto2
co2
url""")

bauteil_obergruppe = ClusterInput()
bauteil_obergruppe_2 = ClusterInput()
data = ClusterInput()
data_2 = Data(data)
title = Data(panel)
bauteil_obergruppe_3 = Data(bauteil_obergruppe)
bauteil_gruner = Data(bauteil_obergruppe_2)
list = ValueList({"bauteil_obergruppe", "bauteil_gruner", "material"}, selected="bauteil_gruner")
list_2 = ValueList({"bauteil_obergruppe", "bauteil_gruner", "material"}, selected="bauteil_obergruppe")
panel_2 = Panel("""bauteil_obergruppe
bauteil_gruner
material""")
cluster = Cluster(S=title, M=list_2, data=data_2)  # -> S_2, M_2, L
panel_4 = Panel(cluster.L)
cluster_2 = Cluster_2(category=cluster.S_2, chosenitem=bauteil_obergruppe_3, dataid=cluster.M_2)
data_topic = Data(title)
alldata = Data(data_2)
python = GhPythonScript(data=cluster_2)  # -> union, quan; inputs data: tree
# ---------- python: Python ----------
def intersection_of_lists(nested_list):
    # Check if the nested list is empty or contains only empty lists
    if not nested_list or all(len(sublist) == 0 for sublist in nested_list):
        return [], 0

    # Initialize the intersection set with the first sublist to compare with others
    intersection_set = set(nested_list[0])
    
    # Iterate over each sublist in the nested list starting from the second sublist
    for sublist in nested_list[1:]:
        # Update the intersection set to keep only elements also found in the current sublist
        intersection_set.intersection_update(sublist)
    
    # Convert the set back to a list to get the final intersection list
    intersection_list = list(intersection_set)
    
    # Return the intersection list and the number of elements in the intersection
    return intersection_list, len(intersection_list)

listList = []
for d in data.Branches:
    if len(d) == 0:
        continue
    listList.append(d)

union, quan = intersection_of_lists(listList)
# ---------- end python ----------

# ----
# Quantity of items matching filters
panel_5 = Panel(python.quan)

cluster_3 = BranchLook(data=alldata, i=python.union)
cluster_4 = Cluster(S=title, M=list, data=cluster_3)  # -> S_2, M_2, L
panel_6 = Panel(cluster_4.L)
cluster_5 = Cluster_2(category=cluster_4.S_2, chosenitem=bauteil_gruner, dataid=cluster_4.M_2)
python_2 = GhPythonScript(data=cluster_5)  # -> union, quan; inputs data: tree; same code as python

# ----
# Quantity of items matching filters
panel_7 = Panel(python_2.quan)

cluster_6 = BranchLook(data=cluster_3, i=python_2.union)
data_3 = Data(cluster_6)
num = Data(python_2.quan)
data_4 = ClusterOutput(data_3)
num_2 = ClusterOutput(num)

# ==== cluster DoorDB
data = ClusterInput()
data_2 = Data(data)
panel = Panel("""7
8
12""")
item = ListItem(List=data_2, Index=panel, Wrap=True)
panel_2 = Panel("""bauteil_obergruppe
bauteil_gruner
uuid
kosten
zustand
material
ref_gebauede_geschoss
breite
hoehe
tiefe
flaeche
masse
anzahl
foto1
foto2
co2
url""")
python = GhPythonScript(x=item, y=data_2)  # -> out, filt_data, filt_attr; inputs x: tree, y: tree
# ---------- python: Python ----------
import ghpythonlib.treehelpers as th

filt_data = []
filt_attr = []
for data, attr in zip(x.Branches, y.Branches):
    addBool = 1
    for d in data:
        if str(d) == "FALSE":
            addBool = 0

    if addBool:
        filt_data.append(data)
        filt_attr.append(attr)

filt_data = th.list_to_tree(filt_data)
filt_attr = th.list_to_tree(filt_attr)
# ---------- end python ----------
item_2 = ListItem(List=python.filt_data, Index=0, Wrap=True)  # -> flatten(Item), flatten(Item1), flatten(Item2)
python_2 = GhPythonScript(attr=python.filt_attr, item=panel_2)  # -> out, graft(all_dict_list); inputs attr: tree, item: list
# ---------- python_2: Python ----------
import ghpythonlib.treehelpers as th

class openingAttr:
    def __init__(self, attr, **kwargs):
        self.attr = attr
        for key, value in kwargs.items():
            setattr(self, key, value)

all_dict_list = []
for at in attr.Branches:
    tempDict = {}
    for key, data in zip(item, at):
        tempDict[key] = data
        
    attrObj = openingAttr(tempDict, **tempDict) 
    all_dict_list.append(attrObj)

all_dict_list = th.list_to_tree(all_dict_list)
# ---------- end python_2 ----------
rectangle = Rectangle(Plane=PlaneXY(0, 0, 0), XSize=item_2.Item, YSize=item_2.Item1, Radius=0)  # -> simplify(graft(Rectangle)), Length
graft = GraftTree(Tree=item_2.Item2, IncludeEmptyLists=True, IncludeNullItems=True)  # -> simplify(Tree)
python_3 = GhPythonScript(identity="door", geometry=rectangle.Rectangle, quantity=graft, attr=python_2.all_dict_list)  # -> out, objList; inputs geometry: tree of Rectangle3d, quantity: tree of Int32, attr: tree
# ---------- python_3: Python ----------
class BuildingComponent:
    def __init__(self, identity, geometry, quantity, attr):
        self.identity = identity
        self.geometry = geometry
        self.quantity = quantity
        self.attr = attr.attr
        for key, value in attr.attr.items():
            setattr(self, key, value)

objList = []
for geo, qua, at in zip(geometry.Branches, quantity.Branches, attr.Branches):
    obj = BuildingComponent(identity, geo[0], qua[0], at[0])
    objList.append(obj)
# ---------- end python_3 ----------
data_3 = Data(python_3.objList)
data_4 = ClusterOutput(data_3)

# ==== cluster WindowDB
data = ClusterInput()
data_2 = Data(data)
panel = Panel("""7
8
12""")
item = ListItem(List=data_2, Index=panel, Wrap=True)
panel_2 = Panel("""bauteil_obergruppe
bauteil_gruner
uuid
kosten
zustand
material
ref_gebauede_geschoss
breite
hoehe
tiefe
flaeche
masse
anzahl
foto1
foto2
co2
url""")
python = GhPythonScript(x=item, y=data_2)  # -> out, filt_data, filt_attr; inputs x: tree, y: tree; same code as python
item_2 = ListItem(List=python.filt_data, Index=0, Wrap=True)  # -> flatten(Item), flatten(Item1), flatten(Item2)
python_2 = GhPythonScript(attr=python.filt_attr, item=panel_2)  # -> out, graft(all_dict_list); inputs attr: tree, item: list; same code as python_2
rectangle = Rectangle(Plane=PlaneXY(0, 0, 0), XSize=item_2.Item, YSize=item_2.Item1, Radius=0)  # -> simplify(graft(Rectangle)), Length
graft = GraftTree(Tree=item_2.Item2, IncludeEmptyLists=True, IncludeNullItems=True)  # -> simplify(Tree)
python_3 = GhPythonScript(identity="window", geometry=rectangle.Rectangle, quantity=graft, attr=python_2.all_dict_list)  # -> out, objList; inputs geometry: tree of Rectangle3d, quantity: tree of Int32, attr: tree; same code as python_3
data_3 = Data(python_3.objList)
data_4 = ClusterOutput(data_3)

# ==== cluster TileFacadeViewer
sddp = ShapeDiverDocumentPayload({AbsoluteTolerance=0, AngleTolerance=0, DistanceDisplayPrecision=0, GltfVersion="Gltf2", GrasshopperVersion="1.0.0007", InputGroups="{}", OutputGroups="{}", RelativeTolerance=0, RhinoVersion="7.30.23163.13001", UnitSystem=0, VersionCreated="1.16.1.0", VersionSaved="1.16.1.0"})
# This component is the visualization of tile facade style.
# This one can input mutiple wall information
visualobj = ClusterInput()
N = ClusterInput()
openingdist = ClusterInput()
python = GhPythonScript(visualObj=visualobj)  # -> out, comb, tileGeometry, allTypeMaterial, substructureGeo, wallFrame, offsetCladdingDist, doorGeo, windowGeo; inputs visualObj: list
# ---------- python: Python ----------
from Grasshopper.Kernel.Data import GH_Path
from Grasshopper import DataTree
import System.Array as array
import ghpythonlib.treehelpers as th

attrList = ['comb', 'tileGeometry', 'allTypeMaterial', 'substructureGeo', 'wallFrame', 'offsetCladdingDist', 'doorGeo', 'windowGeo']
for name in attrList:
    globals()[name] = DataTree[object]()

for i, obj in enumerate(visualObj):
    def treeGenerate(obj, name):
        data = getattr(obj, name)
        
        if isinstance(data, DataTree[object]):
            for j, (d, pList) in enumerate(zip(data.Branches, data.Paths)):
                pList[0] = i
                path = GH_Path(array[int](list(pList)))
                globals()[name].AddRange(d, path)
                
        elif isinstance(data, list):
            path = GH_Path(array[int]([i]))
            globals()[name].AddRange(data, path)
        
        elif len([data])==1:
            path = GH_Path(array[int]([i]))
            globals()[name].AddRange([data], path)
            
        
    for n in attrList:
        treeGenerate(obj, n)
# ---------- end python ----------
deplane = DeconstructPlane(Plane=python.wallFrame)  # -> Origin, XAxis, YAxis, ZAxis
neg = Negative(Value=deplane.ZAxis)
amp = Amplitude(Vector=neg, Amplitude=python.offsetCladdingDist)
lng = ListLength(List=flatten(python.wallFrame))
tstat = TreeStatistics(Tree=python.allTypeMaterial)  # -> Paths, Length, Count
division = Division(A=tstat.Count, B=lng)
python_2 = GhPythonScript(x=python.allTypeMaterial)  # -> out, a
# ---------- python_2: Python ----------
a =x
# ---------- end python_2 ----------
openingdist_2 = Data(openingdist)
geo = Geometry(python.doorGeo)
geo_2 = Geometry(python.windowGeo)
series = Series(Start=0, Step=N, Count=expr("x+1", division))
series_2 = Series(Start=0, Step=1, Count=division)
pln = Plane(python.wallFrame)
deplane_2 = DeconstructPlane(Plane=pln)  # -> Origin, XAxis, YAxis, ZAxis
python_3 = GhPythonScript(x=series)  # -> out, a, b; inputs x: list
# ---------- python_3: Python ----------
a = x[:-1]
b = x[-1]
# ---------- end python_3 ----------
deplane_3 = DeconstructPlane(Plane=python.wallFrame)  # -> Origin, XAxis, YAxis, ZAxis
python_4 = GhPythonScript(x=python.tileGeometry)  # -> out, a; same code as python_2
panel = Panel(python.tileGeometry)
item = ListItem(List=flatten(python.comb), Index=0, Wrap=True)
move_ver1 = GhPythonScript(geoData=python_2.a, vecData=amp)  # -> out, moveGeo; inputs geoData: tree of Brep, vecData: tree
# ---------- move_ver1: Python ----------
import Rhino.Geometry as rg
from Grasshopper.Kernel.Data import GH_Path
from Grasshopper import DataTree
import System.Array as array
import ghpythonlib.treehelpers as th

moveGeo = DataTree[object]()
for geoList, path in zip(geoData.Branches, geoData.Paths):
    n = path[0]
    vec = vecData.Branches[n][0]
    matrix = rg.Transform.Translation(vec)

    for geo in geoList:
        geo.Transform(matrix)
    
    moveGeo.AddRange(geoList, path)
# ---------- end move_ver1 ----------
amp_2 = Amplitude(Vector=deplane_2.ZAxis, Amplitude=openingdist_2)
null = NullItem(Item=item)  # -> NullFlags, InvalidFlags, Description
cladding_catergory = CladdingCatergory(data=python.comb, geo=python.tileGeometry)  # -> geo_5, data_4
move_ver1_2 = GhPythonScript(geoData=geo, vecData=amp_2)  # -> out, moveGeo; inputs geoData: tree of Brep, vecData: tree; same code as move_ver1
gradient = Gradient(
    LowerLimit="0",
    UpperLimit=division,
    Parameter=series_2,
    stops=[0: RGB(234, 38, 0), 0.25: RGB(234, 126, 0), 0.5: RGB(254, 244, 84), 0.75: RGB(173, 203, 249), 1: RGB(75, 107, 169)])
move_ver1_3 = GhPythonScript(geoData=geo_2, vecData=amp_2)  # -> out, moveGeo; inputs geoData: tree of Brep, vecData: tree; same code as move_ver1
amp_3 = Amplitude(Vector=deplane_3.ZAxis, Amplitude=python_3.a)
pshift = ShiftPaths(Data=move_ver1.moveGeo, Offset=-1)
amp_4 = Amplitude(Vector=deplane_3.ZAxis, Amplitude=python_3.b)  # -> graft(Vector)
tstat_2 = TreeStatistics(Tree=cladding_catergory.geo_5)  # -> Paths, Length, Count
filter = StreamFilter(Gate=null.NullFlags, Stream0=cladding_catergory.geo_5, Stream1=python_4.a)
filter_2 = StreamFilter(Gate=null.NullFlags, Stream0=cladding_catergory.geo_5, Stream1=python_4.a)
move_ver2 = GhPythonScript(geoData=pshift, vecData=amp_3)  # -> out, moveGeo; inputs geoData: tree of Brep, vecData: tree
# ---------- move_ver2: Python ----------
import Rhino.Geometry as rg
from Grasshopper.Kernel.Data import GH_Path
from Grasshopper import DataTree
import System.Array as array
import ghpythonlib.treehelpers as th

moveGeo = DataTree[object]()
for geoList, path in zip(geoData.Branches, geoData.Paths):
    wallNum = path[0]
    layerNum = path[path.Length-1]
    vec = vecData.Branches[wallNum]
    matrix = rg.Transform.Translation(vec[layerNum])

    for geo in geoList:
        geo.Transform(matrix)
    
    moveGeo.AddRange(geoList, path)
# ---------- end move_ver2 ----------
move_ver1_4 = GhPythonScript(geoData=move_ver1_2.moveGeo, vecData=amp)  # -> out, moveGeo; inputs geoData: tree of Brep, vecData: tree; same code as move_ver1
move_ver1_5 = GhPythonScript(geoData=move_ver1_3.moveGeo, vecData=amp)  # -> out, moveGeo; inputs geoData: tree of Brep, vecData: tree; same code as move_ver1
division_2 = Division(A=tstat_2.Count, B=lng)
move_ver1_6 = GhPythonScript(geoData=filter, vecData=amp)  # -> out, moveGeo; inputs geoData: tree of Brep, vecData: tree; same code as move_ver1
tstat_3 = TreeStatistics(Tree=filter_2)  # -> Paths, Length, Count
dup = DuplicateData(Data=gradient, Number=lng, Order=True)  # -> graft(Data)
series_3 = Series(Start=0, Step=1, Count=tstat_3.Count)  # -> graft(Series)
move = Move(Geometry=python.substructureGeo, Motion=amp)  # -> Geometry, Transform
edges = BrepEdges(Brep=move_ver2.moveGeo)  # -> Naked, Interior, NonManifold
panel_2 = Panel("""20
10""")
panel_3 = Panel("""20
10""")
geo_3 = Geometry(move_ver2.moveGeo)
filter_3 = StreamFilter(Gate=null.NullFlags, Stream0=division_2, Stream1=tstat_3.Count)
filter_4 = StreamFilter(Gate=null.NullFlags, Stream0=cladding_catergory.data_4, Stream1=series_3)
move_ver1_7 = GhPythonScript(geoData=move_ver1_6.moveGeo, vecData=amp_4)  # -> out, moveGeo; inputs geoData: tree of Brep, vecData: tree; same code as move_ver1
move_2 = Move(Geometry=move.Geometry, Motion=amp_4)  # -> Geometry, Transform
dash = DashPattern(Curve=move_ver1_4.moveGeo, Pattern=panel_2)  # -> Dashes, Gaps
dash_2 = DashPattern(Curve=move_ver1_5.moveGeo, Pattern=panel_3)  # -> Dashes, Gaps
crv = Curve([edges.Interior, edges.Naked])
gradient_2 = Gradient(
    LowerLimit=0,
    UpperLimit=filter_3,
    Parameter=filter_4,
    stops=[0: RGB(145, 107, 64), 0.267: RGB(234, 126, 0), 0.498: RGB(245, 207, 81), 0.772: RGB(235, 221, 185), 1: RGB(199, 98, 58)])
geo_4 = Geometry(move_2.Geometry)
door = Data(dash.Dashes)
window = Data(dash_2.Dashes)
edges_2 = BrepEdges(Brep=move_ver1_7.moveGeo)  # -> Naked, Interior, NonManifold
edges_3 = BrepEdges(Brep=geo_4)  # -> Naked, Interior, NonManifold
unflatten = UnflattenTree(Tree=gradient_2, Guide=move_ver1_7.moveGeo)
crv_2 = Curve([edges_2.Naked, edges_2.Interior, crv, edges_3.Naked, edges_3.Interior])
movegeo = ClusterOutput(move_ver1_7.moveGeo)
window_2 = ClusterOutput(window)
T = ClusterOutput(unflatten)
crv_3 = ClusterOutput(crv_2)
geo_5 = ClusterOutput(geo_4)
geo_6 = ClusterOutput(geo_3)
D = ClusterOutput(dup)
door_2 = ClusterOutput(door)

# ==== cluster NormFacadeViewer
# This component is the visualization of normal facade style.
# This one can input mutiple wall information
relay = ClusterInput()
relay_2 = ClusterInput()
relay_3 = ClusterInput()
python = GhPythonScript(visualObj=relay)  # -> out, comb, tileGeometry, allTypeMaterial, substructureGeo, wallFrame, offsetCladdingDist, doorGeo, windowGeo; inputs visualObj: list; same code as python
deplane = DeconstructPlane(Plane=python.wallFrame)  # -> Origin, XAxis, YAxis, ZAxis
neg = Negative(Value=deplane.ZAxis)
amp = Amplitude(Vector=neg, Amplitude=python.offsetCladdingDist)
lng = ListLength(List=flatten(python.wallFrame))
tstat = TreeStatistics(Tree=python.allTypeMaterial)  # -> Paths, Length, Count
division = Division(A=tstat.Count, B=lng)
python_2 = GhPythonScript(x=python.allTypeMaterial)  # -> out, a; same code as python_2
series = Series(Start=0, Step=relay_2, Count=expr("x+1", division))
series_2 = Series(Start=0, Step=1, Count=division)
python_3 = GhPythonScript(x=series)  # -> out, a, b; inputs x: list; same code as python_3
deplane_2 = DeconstructPlane(Plane=python.wallFrame)  # -> Origin, XAxis, YAxis, ZAxis
python_4 = GhPythonScript(x=python.tileGeometry)  # -> out, a; same code as python_2
item = ListItem(List=flatten(python.comb), Index=0, Wrap=True)
move_ver1 = GhPythonScript(geoData=python_2.a, vecData=amp)  # -> out, moveGeo; inputs geoData: tree of Brep, vecData: tree; same code as move_ver1
null = NullItem(Item=item)  # -> NullFlags, InvalidFlags, Description
openingdist = Data(relay_3)
geo = Geometry(python.doorGeo)
geo_2 = Geometry(python.windowGeo)
cladding_catergory = CladdingCatergory(data=python.comb, geo=python.tileGeometry)  # -> geo_5, data_4; disabled
gradient = Gradient(
    LowerLimit="0",
    UpperLimit=division,
    Parameter=series_2,
    stops=[0: RGB(234, 38, 0), 0.25: RGB(234, 126, 0), 0.5: RGB(254, 244, 84), 0.75: RGB(173, 203, 249), 1: RGB(75, 107, 169)])
amp_2 = Amplitude(Vector=deplane_2.ZAxis, Amplitude=python_3.a)
pshift = ShiftPaths(Data=move_ver1.moveGeo, Offset=-1)
pln = Plane(python.wallFrame)
amp_3 = Amplitude(Vector=deplane_2.ZAxis, Amplitude=python_3.b)  # -> graft(Vector)
tstat_2 = TreeStatistics(Tree=cladding_catergory.geo_5)  # -> Paths, Length, Count
filter = StreamFilter(Gate=null.NullFlags, Stream0=cladding_catergory.geo_5, Stream1=python_4.a)
filter_2 = StreamFilter(Gate=null.NullFlags, Stream0=cladding_catergory.geo_5, Stream1=python_4.a)
move_ver2 = GhPythonScript(geoData=pshift, vecData=amp_2)  # -> out, moveGeo; inputs geoData: tree of Brep, vecData: tree; same code as move_ver2
deplane_3 = DeconstructPlane(Plane=pln)  # -> Origin, XAxis, YAxis, ZAxis
tstat_3 = TreeStatistics(Tree=filter)  # -> Paths, Length, Count
amp_4 = Amplitude(Vector=deplane_3.ZAxis, Amplitude=openingdist)
dup = DuplicateData(Data=gradient, Number=lng, Order=True)  # -> graft(Data)
move_ver1_2 = GhPythonScript(geoData=filter_2, vecData=amp)  # -> out, moveGeo; inputs geoData: tree of Brep, vecData: tree; same code as move_ver1
division_2 = Division(A=tstat_2.Count, B=lng)
division_3 = Division(A=tstat_3.Count, B=lng)
move = Move(Geometry=python.substructureGeo, Motion=amp)  # -> Geometry, Transform
edges = BrepEdges(Brep=move_ver2.moveGeo)  # -> Naked, Interior, NonManifold
move_ver1_3 = GhPythonScript(geoData=geo, vecData=amp_4)  # -> out, moveGeo; inputs geoData: tree of Brep, vecData: tree; same code as move_ver1
move_ver1_4 = GhPythonScript(geoData=geo_2, vecData=amp_4)  # -> out, moveGeo; inputs geoData: tree of Brep, vecData: tree; same code as move_ver1
geo_3 = Geometry(move_ver2.moveGeo)
series_3 = Series(Start=0, Step=1, Count=division_3)  # -> graft(Series)
move_ver1_5 = GhPythonScript(geoData=move_ver1_2.moveGeo, vecData=amp_3)  # -> out, moveGeo; inputs geoData: tree of Brep, vecData: tree; same code as move_ver1
move_2 = Move(Geometry=move.Geometry, Motion=amp_3)  # -> Geometry, Transform
crv = Curve([edges.Interior, edges.Naked])
filter_3 = StreamFilter(Gate=null.NullFlags, Stream0=division_2, Stream1=division_3)
filter_4 = StreamFilter(Gate=null.NullFlags, Stream0=cladding_catergory.data_4, Stream1=series_3)
move_ver1_6 = GhPythonScript(geoData=move_ver1_3.moveGeo, vecData=amp)  # -> out, moveGeo; inputs geoData: tree of Brep, vecData: tree; same code as move_ver1
move_ver1_7 = GhPythonScript(geoData=move_ver1_4.moveGeo, vecData=amp)  # -> out, moveGeo; inputs geoData: tree of Brep, vecData: tree; same code as move_ver1
geo_4 = Geometry(move_2.Geometry)
edges_2 = BrepEdges(Brep=move_ver1_5.moveGeo)  # -> Naked, Interior, NonManifold
edges_3 = BrepEdges(Brep=geo_4)  # -> Naked, Interior, NonManifold
gradient_2 = Gradient(
    LowerLimit=0,
    UpperLimit=filter_3,
    Parameter=filter_4,
    stops=[0: RGB(145, 107, 64), 0.267: RGB(234, 126, 0), 0.498: RGB(245, 207, 81), 0.772: RGB(235, 221, 185), 1: RGB(199, 98, 58)])
panel = Panel("""20
10""")
panel_2 = Panel("""20
10""")
dash = DashPattern(Curve=move_ver1_6.moveGeo, Pattern=panel)  # -> Dashes, Gaps
dash_2 = DashPattern(Curve=move_ver1_7.moveGeo, Pattern=panel_2)  # -> Dashes, Gaps
crv_2 = Curve([edges_2.Naked, edges_2.Interior, crv, edges_3.Naked, edges_3.Interior])
unflatten = UnflattenTree(Tree=gradient_2, Guide=move_ver1_5.moveGeo)  # disabled
door = Data(dash.Dashes)
window = Data(dash_2.Dashes)
window_2 = ClusterOutput(window)
movegeo = ClusterOutput(move_ver1_5.moveGeo)
C = ClusterOutput(gradient_2)
crv_3 = ClusterOutput(crv_2)
geo_5 = ClusterOutput(geo_3)
D = ClusterOutput(dup)
door_2 = ClusterOutput(door)

# ==== cluster TileMockData
num = ClusterInput()
num_2 = Data(num)
series = Series(Start=0, Step=1, Count="3")
panel = Panel("""bauteil_obergruppe
bauteil_gruner
uuid
kosten
zustand
material
ref_gebauede_geschoss
breite
hoehe
tiefe
flaeche
masse
anzahl
foto1
foto2
co2
url""")
item = ListItem(List=series, Index=0, Wrap=True)  # -> Item, Item1, Item2
dom = ConstructDomain(DomainStart=Slider(10, range=0..10), DomainEnd=Slider(60, range=0..100))
dom_2 = ConstructDomain(DomainStart=Slider(10, range=0..10), DomainEnd=Slider(1120, range=0..10000))
dom_3 = ConstructDomain(DomainStart=Slider(191, range=0..300), DomainEnd=Slider(262, range=0..300))
# width
random = Random(Range=dom, Number=num_2, Seed=item.Item, Integers=True)
# length
random_2 = Random(Range=dom_2, Number=num_2, Seed=item.Item1, Integers=True)
# quantity
random_3 = Random(Range=dom_3, Number=num_2, Seed=item.Item2, Integers=True)
python = GhPythonScript(x=num_2)  # -> out, a; inputs x: Int32
# ---------- python: Python ----------
import uuid
a = []
for i in range(x):
    a.append("MockTile_uuid_" + str(uuid.uuid4()))
# ---------- end python ----------
panel_2 = Panel("""7
8
12
2""")
python_2 = GhPythonScript(x=panel)  # -> out, a; inputs x: list
# ---------- python_2: Python ----------
a = []
for st in x:
    a.append("MockData_"+st)
# ---------- end python_2 ----------
dup = DuplicateData(Data=graft(python_2.a), Number=num_2, Order=True)
merge = Merge(
    Data1=simplify(graft(random)),
    Data2=simplify(graft(random_2)),
    Data3=simplify(graft(random_3)),
    Data4=simplify(graft(python.a)))
flip = FlipMatrix(Data=dup)
replace = ReplaceItems(List=flip, Item=merge, Indices=panel_2, Wrap=False)
data = Data(replace)
item_2 = ListItem(List=data, Index=panel_2, Wrap=True)
python_3 = GhPythonScript(x=item_2, y=data)  # -> out, filt_data, filt_attr; inputs x: tree, y: tree; same code as python
item_3 = ListItem(List=python_3.filt_data, Index=0, Wrap=True)  # -> flatten(Item), flatten(Item1), flatten(Item2)
python_4 = GhPythonScript(attr=python_3.filt_attr, item=panel)  # -> out, graft(all_dict_list); inputs attr: tree, item: list; same code as python_2
rectangle = Rectangle(Plane=PlaneXY(0, 0, 0), XSize=item_3.Item, YSize=item_3.Item1, Radius=0)  # -> simplify(graft(Rectangle)), Length
graft = GraftTree(Tree=item_3.Item2, IncludeEmptyLists=True, IncludeNullItems=True)  # -> simplify(Tree)
# Should check if I need to add attrObj
panel_3 = Panel("tile")
python_5 = GhPythonScript(identity=panel_3, geometry=rectangle.Rectangle, quantity=graft, attr=python_4.all_dict_list)  # -> out, objList; inputs geometry: tree of Rectangle3d, quantity: tree of Int32, attr: tree
# ---------- python_5: Python ----------
class BuildingComponent:
    def __init__(self, identity, geometry, quantity, attr):
        self.identity = identity
        self.geometry = geometry
        self.quantity = quantity
        self.attr = attr.attr
        self.attrObj = attr

objList = []
for geo, qua, at in zip(geometry.Branches, quantity.Branches, attr.Branches):
    obj = BuildingComponent(identity, geo[0], qua[0], at[0])
    objList.append(obj)
# ---------- end python_5 ----------
data_2 = Data(python_5.objList)
data_3 = ClusterOutput(data_2)

# ==== cluster BoardDB_2
data = ClusterInput()
data_2 = Data(data)
panel = Panel("""7
8
12""")
item = ListItem(List=data_2, Index=panel, Wrap=True)
panel_2 = Panel("""bauteil_obergruppe
bauteil_gruner
uuid
kosten
zustand
material
ref_gebauede_geschoss
breite
hoehe
tiefe
flaeche
masse
anzahl
foto1
foto2
co2
url""")
python = GhPythonScript(x=item, y=data_2)  # -> out, filt_data, filt_attr; inputs x: tree, y: tree
# ---------- python: Python ----------
import ghpythonlib.treehelpers as th

filt_data = []
filt_attr = []
for data, attr in zip(x.Branches, y.Branches):
    addBool = 1
    for d in data:
        if str(d) == "FALSE":
            addBool = 0
    
    # check if tiefe is FALSE
    if attr[9] == "FALSE":
        attr[9] = 1
    
    if addBool:
        attr[7] = float(attr[7])
        attr[8] = float(attr[8])
        attr[9] = float(attr[9])
        filt_data.append(data)
        filt_attr.append(attr)

filt_data = th.list_to_tree(filt_data)
filt_attr = th.list_to_tree(filt_attr)
# ---------- end python ----------
item_2 = ListItem(List=python.filt_data, Index=0, Wrap=True)  # -> flatten(Item), flatten(Item1), flatten(Item2)
python_2 = GhPythonScript(attr=python.filt_attr, item=panel_2)  # -> out, graft(all_dict_list); inputs attr: tree, item: list; same code as python_2
rectangle = Rectangle(Plane=PlaneXY(0, 0, 0), XSize=item_2.Item, YSize=item_2.Item1, Radius=0)  # -> simplify(graft(Rectangle)), Length
graft = GraftTree(Tree=item_2.Item2, IncludeEmptyLists=True, IncludeNullItems=True)  # -> simplify(Tree)
python_3 = GhPythonScript(identity="door", geometry=rectangle.Rectangle, quantity=graft, attr=python_2.all_dict_list)  # -> out, objList; inputs geometry: tree of Rectangle3d, quantity: tree of Int32, attr: tree; same code as python_3
data_3 = Data(python_3.objList)
data_4 = ClusterOutput(data_3)

# ==== cluster CladdingCatergory
sddp = ShapeDiverDocumentPayload({AbsoluteTolerance=0, AngleTolerance=0, DistanceDisplayPrecision=0, GltfVersion="Gltf2", GrasshopperVersion="1.0.0007", InputGroups="{}", OutputGroups="{}", RelativeTolerance=0, RhinoVersion="7.30.23163.13001", UnitSystem=0, VersionCreated="1.16.1.0", VersionSaved="1.16.1.0"})
geo = ClusterInput()
data = ClusterInput()
geo_2 = Geometry(geo)
data_2 = Data(data)
int = Integer(flatten(data_2))
cset = CreateSet(List=int)  # -> Set, Map
sort = SortList(Keys=cset.Set)  # -> Keys, ValuesA
lng = ListLength(List=cset.Set)
series = Series(Start=0, Step=1, Count=lng)
python = GhPythonScript(become=series, changed=sort.Keys, changeList=data_2)  # -> out, newList; inputs become: list, changed: list, changeList: tree of Int32
# ---------- python: Python ----------
import ghpythonlib.treehelpers as th

width = become
length = changed

number_mapping = {}
for w, l in zip(width, length):
    number_mapping[l] = w

newList = []
for chList in changeList.Branches:
    newList.append([number_mapping[number] if number in number_mapping else number for number in chList])

newList = th.list_to_tree(newList)
# ---------- end python ----------
unflatten = UnflattenTree(Tree=python.newList, Guide=data_2)
tstat = TreeStatistics(Tree=graft(unflatten))  # -> Paths, Length, Count
dpath = DeconstructPath(Branch=tstat.Paths)
flatten = FlattenTree(Tree=unflatten, Path="{0}")  # -> simplify(graft(Tree))
geo_3 = Geometry(graft(geo_2))
item = ListItem(List=dpath, Index=0, Wrap=True)  # -> simplify(Item)
merge = Merge(Data1=item, Data2=flatten)
tstat_2 = TreeStatistics(Tree=geo_3)  # -> Paths, Length, Count
path = ConstructPath(Indices=merge)  # -> flatten(Branch)
tstat_3 = TreeStatistics(Tree=flatten)  # -> Paths, Length, Count
replace = ReplacePaths(Data=flatten, Search=tstat_3.Paths, Replace=path)
replace_2 = ReplacePaths(Data=geo_3, Search=tstat_2.Paths, Replace=path)
data_3 = Data(replace)
geo_4 = Geometry(replace_2)
geo_5 = ClusterOutput(geo_4)
data_4 = ClusterOutput(data_3)
