# Grasshopper definition 231204_GenScript.gh (Grasshopper 1.0.7)
# plug-ins: RhinoCodePluginGH

# General goal is to go through all the previous precidents and come up with digital tools that can leviate parts of the burden from the student espeacill in area/ co2/ cost estimation but not to help them build the whole house
panel = Panel("Type Selection")
panel_2 = Panel("holz")
panel_3 = Panel("beton")
panel_4 = Panel("stein")
function = ValueList({"structure": 0, "boden": 1, "fassaden": 2, "dach": 3}, selected="structure")
# Packing Algorithm
# for stones and concrete
# 
# you can think of some rules for these 2 materials
# goal for tomorrow
# 1.get UUID script
# 2.define input shape after query
# 3.Orient Script
script = Script()  # -> Out, A
# Rule Generation based on Type of materials and purposes
script_2 = Script(material="stahl", function=function)  # -> out, ruleDisplay, rule; inputs material: String, function: Int32
# ---------- script_2: Python ----------
if material == "stahl" and function == 0:
    ruleDisplay = "Stahl could be extended and cut"

if material == "holz" and function == 0:
    ruleDisplay = "holz could only be cut but could not be extended"

rule = [material, function]
print(rule, ruleDisplay)
# ---------- end script_2 ----------
panel_5 = Panel(script_2.ruleDisplay)
geometry = Geometry([<extrusion referenced from the Rhino model> x6])
geometry_2 = Geometry([<curve referenced from the Rhino model> x4])
panel_6 = Panel("Algorithm provider")
uuid_generator = Script(things=geometry, lines=geometry_2, run=Button())  # -> out, GUID; inputs things: list of Brep, lines: list of Line, run: Boolean
# ---------- uuid_generator: Python ----------
import uuid
# Linking/Setting the UUID to the object
GUID = {}
for thing in things:
    thingID = uuid.uuid1()
    print(thingID)
for line in lines:
    lineID = uuid.uuid1()
    print(lineID)


# order is not important unless it is sorted 
# dimensions are important
# few things you wanna know which piece of woods/ steel it comes from
# the list will extend as you cut it 
Input = [
    {
        "object": "rhino object",
        "quantity":56,
        "length":12,
        "height": 20,
        "width": 65

    }
]
# ---------- end uuid_generator ----------
script_3 = Script(rule=script_2.rule, things=geometry, lines=geometry_2)  # -> out, a; inputs things: list of Brep, lines: list of Line
# ---------- script_3: Python ----------
import Rhino.Geometry as rg


Alg1 = "LengthAlgorithm"
Alg2 = "PackingAlgorithm" 


# LengthAlgorithm Meow
# -------------------------------------------------
# nearest neighbour
def find_closest_element(target, lst):
    return min(lst, key=lambda x: abs(x - target))

# nearest positive neighbour return null if no bigger is found
def find_closest_larger_element(target, lst):
    temp = [list(filter(lambda x: x>=0, map(lambda x: (x-num), target)))
    for num in lst]
    temp = [sublist[0] if len(sublist) != 0 else None for sublist in temp]
    return temp


def find_closest_elements(list_a, list_b, mode):
    if mode == "cloest":
        return [find_closest_element(target, list_a) for target in list_b]
    elif mode == "cloestPositive":
        return [find_closest_larger_element(target, list_a) if target != None else None
        for target in list_b]

# List_a should contain UUID of the object 
# ideallly it should be a list of dictionary of 
# {UUID, Length, Quantity}
list_a = [4000, 4000, 4000, 6000, 6000, 5500]
UUID_a = ["a", "b", "c", "d", "e"]
list_b = [line.Length for line in lines]

result = find_closest_elements(list_a, list_b, "cloest")
# print(find_closest_larger_element(list_a, list_b))

# On what cases are possible to add ? 
# for line in lines:
#     print(line.Length)


print(result)
# ---------- end script_3 ----------
# the generation of UUID should only run once and then save.
panel_7 = Panel(uuid_generator.GUID)
panel_8 = Panel("Optimization")
panel_9 = Panel("Visualization")
