# Grasshopper definition 231227_GenScript.gh (Grasshopper 1.0.7)
# plug-ins: RhinoCodePluginGH, Pufferfish

panel = Panel("beton")
panel_2 = Panel("stein")
function = ValueList({"structure": 0, "boden": 1, "fassaden": 2, "dach": 3}, selected="structure")
# General goal is to go through all the previous precidents and come up with digital tools that can leviate parts of the burden from the student espeacill in area/ co2/ cost estimation but not to help them build the whole house
# Task today
# - Orient object based on UUID
# 
# - Cut something and automatically add it into the linked list
# 
# - Set the script automatic for detecting cut in layers
# Task today
# - Solve Duplicate Problem with linked list
# 
# - Look at Dynamic progrtamming
# 
# - Check why the new geometry are not taken into account
# 
# - Optimizatzion no need to create a new linked list everytime things are added but need to add node and recalculate best match
# 
# - Mapping the Text Name
# 
# - The order of the list will affect which one is best match
panel_3 = Panel("Type Selection")
panel_4 = Panel("stahl")
# Rule Generation based on Type of materials and purposes
script = Script(material="holz", function=function)  # -> out, ruleDisplay, rule; inputs material: String, function: Int32
# ---------- script: Python ----------
if material == "stahl" and function == 0:
    ruleDisplay = "Stahl could be extended and cut"

if material == "holz" and function == 0:
    ruleDisplay = "holz could only be cut but could not be extended"

rule = [material, function]
print(rule, ruleDisplay)
# ---------- end script ----------
panel_5 = Panel(script.ruleDisplay)
run = BooleanToggle(False)  # disabled
reset = Button()  # disabled
interval = Slider(800, range=0..1000)  # disabled
run_2 = Button(ExpressionNormal="True", ExpressionPressed="False")
# The original Material shiould have one linked list and keep appending/ prepending to that list.
# Opt1- Greedy
# Algorithm
# Opt2- Dynamic Programming
# Opt 3 - Sorted Linked List
# define connectors
# what kind of connectors should there be
# parameter to decide
# optimisation
# Task Today
# 
# 
# 2. Research a bit on connectors and infill between structure and  cladding
# 3.Study DSA and Dynamic Programming
# task it to do a 1. connector script
# 2. To combine multiple things for the length of one line.
# 3. Minimise cut/ minimise waste
panel_6 = Panel("Algorithm provider")
geometry_pipeline = GeometryPipeline(
    GroupByLayer=False,
    GroupByType=False,
    IncludeHidden=True,
    IncludeLocked=True,
    LayerFilter="BFH_ReUse24::Workspace",
    NameFilter="*",
    SublayerFiltering=True,
    TypeFilter=1073741848)
geometry_pipeline_2 = GeometryPipeline(
    GroupByLayer=False,
    GroupByType=False,
    IncludeHidden=True,
    IncludeLocked=True,
    LayerFilter="BFH_ReUse24::Structure",
    NameFilter="*",
    SublayerFiltering=True,
    TypeFilter=4)
uuid_generator = Script(things=geometry_pipeline, lines=geometry_pipeline_2, run=run_2, rule=run_2)  # -> out, GUID_THINGS, GUID_LINES; inputs things: list, lines: list of Curve, run: Boolean
# ---------- uuid_generator: Python ----------
import Rhino
import copy
import rhinoscriptsyntax as rs
import Rhino.Geometry as rg

# Namespace definition
# -------------------------------------------------
class GUID:
    def __init__ (self, ID, Geometry, Type):
        self.ID = ID
        self.Geometry = Geometry #saving the rhino geometry
        self.Type = Type
        self.Cut = None
        self.update_info()

    def update_info(self, mode = None, manual = None):
        if mode == "Manual":
            self.Length -= manual[0]
            T = rg.Transform.Translatation(manual[1])
            self.AxisX.PointAtStart.Transform(T)
            self.y_cut_plan = manual[2]
        if self.Type == "Brep":
            self.info = self.bounding_box_dimensions(self.Geometry)
            self.Length = self.info[0][0]
            self.Width = self.info[0][1]
            self.Height = self.info[0][2]
            self.AxisX = self.info[1][0]
            self.AxisY = self.info[1][1]
            self.AxisZ = self.info[1][2]
            self.x_cut_plane = self.info[2][0]
            self.y_cut_plane = self.info[2][1]
            self.z_cut_plane = self.info[2][2]
            self.Bbox = self.info[3]
        elif self.Type == "Line":
            if type(self.Geometry) == rg.Line:
                self.Length = self.Geometry.Length
                return
            self.Length = rg.Curve.GetLength(self.Geometry)


    def bounding_box_dimensions(self, obj):
        if type(obj) == rg.Brep:
            vertices = [vertex.Location for vertex in obj.Vertices]
            bounding_box = rg.BoundingBox(vertices)
        else:
            vertices = [vertex.Location for vertex in obj.ToBrep().Vertices]
            bounding_box = rg.BoundingBox(vertices)

        # Calculate the dimensions of the bounding box
       
        x_extent = bounding_box.Max.X - bounding_box.Min.X
        y_extent = bounding_box.Max.Y - bounding_box.Min.Y
        z_extent = bounding_box.Max.Z - bounding_box.Min.Z
        


        # Create the start and end points of the central axis
        center = bounding_box.Center
        start_pointX = rg.Point3d(center.X - x_extent / 2, center.Y, center.Z)
        end_pointX = rg.Point3d(center.X + x_extent / 2, center.Y, center.Z)

        start_pointY = rg.Point3d(center.X , center.Y - y_extent / 2, center.Z)
        end_pointY = rg.Point3d(center.X , center.Y + y_extent / 2, center.Z)

        start_pointZ = rg.Point3d(center.X, center.Y, center.Z -z_extent/2)
        end_pointZ = rg.Point3d(center.X, center.Y, center.Z + z_extent)


        x_line = rg.LineCurve(start_pointX, end_pointX)
        y_line = rg.LineCurve(start_pointY, end_pointY)
        z_line = rg.LineCurve(start_pointZ, end_pointZ)

        x_cut_plane = rg.Plane(rg.Point3d(start_pointX.X, start_pointX.Y-y_extent/2, start_pointX.Z),
        rg.Vector3d(0,1,0))
        y_cut_plane = rg.Plane(rg.Point3d(start_pointY.X - x_extent/2, start_pointY.Y, start_pointY.Z), 
        rg.Vector3d(1,0,0))
        z_cut_plane = rg.Plane(rg.Point3d(start_pointZ.X , start_pointZ.Y, start_pointZ.Z),
        rg.Vector3d(0,0,1))

        return ((x_extent, y_extent, z_extent),
                (x_line, y_line, z_line),
                (x_cut_plane, y_cut_plane, z_cut_plane),
                bounding_box)

    def factory_method(self, ID, Geometry, Type):
        G = GUID(ID, Geometry,Type)
        return G

class NODE:
    def __init__(self, value):
        self.next = None
        self.value = value #self.value = GUID(ID, Geometry)
        self.closest = None #for lines, the cloest one to other link list
        self.CD = 100000000

    def split(self, obj, linked_list, obj_type, length = None):
        # Caution: Brep here is a Brep List !!!
        if self.value is not None:
            if obj_type == "Brep":
                self.value.Geometry = obj[0]
                self.value.update_info()
                splited_Node = NODE(GUID(self.value.ID + "/", obj[1], "Brep"))
                splited_Node.next = self.next
                self.next = splited_Node
            if obj_type == "Line":
                # Line is just a single line cryyy so dumb RG
                start_pt = rg.PointAtStart
                end_pt = rg.PointAtEnd
                pt = obj.DivideByLength(length, True, False)
                line1 = rg.Line(start_pt, pt)
                line2 = rg.Line(pt, end_pt)
                self.value.Geometry = line1
                self.value.update_info()
                splited_Node = NODE(GUID(self.value.ID + "/", line2, "Line"))
                splited_Node.next = self.next
                self.next = splited_Node
            
            linked_list.length += 1

    def factory_method(self, ID, obj, obj_type = "Line"):
        N = NODE(value = GUID(ID, obj, obj_type))
        return N

class LINKEDLIST:
    def __init__ (self):
        self.node = None
        self.head = None
        self.tail = None
        self.length = 0
    
    def append(self, value):
        newNode = NODE(value)
        current = self.head
        self.length += 1
        if self.head == None:
            self.head = newNode
            self.tail = newNode
            return newNode
        while current.next != None:
            current = current.next
        current.next = newNode
        self.tail = newNode
        return newNode

    def prepend(self, value):
        newNode = NODE(value)
        self.length +=1
        if self.head == None:
            self.head = newNode
            self.tail = newNode
            return self
        newNode.next = self.head
        self.head = newNode
        return self

    def traverse(self, action = None):
        current = self.head
        while current != None:
            if action:
                action()
            else:
                print(current)
            current = current.next

    def goto(self, position):
        current = self.head
        for i in range(position):
            if current != None:
                current = current.next
            else:
                raise IndexError("Index out of range")

        return current

    def pop(self, position = None):
        if position == None:
            position = self.length -1
            self.length -= 1
        if position == 0:
            if self.head != None:
                pop = self.goto(position)
                self.head = self.head.next
                self.length -= 1
                return pop
            else: 
                raise IndexError("Index out of range")
        if position >= self.length or position < 0:
            raise Exception("index out of range")

        previous = self.goto(position- 1)
        if previous != None and previous.next != None:
            previous.next = previous.next.next
            self.length -= 1
        else:
            raise IndexError("Index out of range")
        return previous

    
    def insert(self, value, position):
        # pass exception here eg position > self.length
        node = NODE(value)
        pointer1 = self.goto(position -1 )
        pointer2 = pointer1.next.next
        pointer1.next = node
        node.next = pointer2
        self.lenth += 1
        return node
    
    def list_export(self, attribute):
        lst = []
        current = self.head
        while current != None:
            value_attribute = getattr(current.value, attribute)
            lst.append(value_attribute)
            current = current.next
        return lst

    def copy(self):
        LS = LINKEDLIST()
        current = self.head
        while current != None:
            new_node = NODE(copy.deepcopy(current.value))
            LS.append(new_node)
            current = current.next
        return LS
    
    def concat(self, linked_list):
        if linked_list.head == None or self.head == None:
            raise Exception("Sorry both list must not be empty la")
        linked_list_tail = linked_list.tail
        self.tail.next = linked_list.head
        self.tail = linked_list_tail
        self.length += linked_list.length
        return self
    
    def factory_method(self):
        LS = LINKEDLIST()
        return LS



# -------------------------------------------------
GUID_LINES = LINKEDLIST()
GUID_THINGS = LINKEDLIST()

# for test purpose

if run:
    for i,thing in enumerate(things):

        thingID = "thing" + str(i)        
        obj = GUID(thingID, thing, "Brep")

        GUID_THINGS.prepend(obj)
        
    for i, line in enumerate(lines):
        lineID = "line" + str(i)
        obj = GUID(lineID, line.ToNurbsCurve(), "Line")
        GUID_LINES.prepend(obj)
# ---------- end uuid_generator ----------
script_2 = Script(things=uuid_generator.GUID_THINGS, lines=uuid_generator.GUID_LINES, attribute="Length")  # -> out, result, a; inputs attribute: String
# ---------- script_2: Python ----------
import Rhino.Geometry as rg



# Later need to convert the below code to be search for linkedlist
# print(things.head.value.ID)
# list_a = things.list_export("Length")
# list_b = lines.list_export("Length")


# LengthAlgorithm Meow
# -------------------------------------------------
# nearest neighbour
# the remaining length i want to find a fitting length to map to it

def find_closest_element(linked_list_a, linked_list_b, attribute):
    result = {}
    lenD = []
    cache = {
        "Geometry": None,
        "lenD": None,
    }

    current_b = linked_list_b.head
    while current_b != None:
        target = getattr(current_b.value, attribute)
        current_a = linked_list_a.head
        closest_value = None
        closest_distance = 10000000

        while current_a != None:
            d1 = target - getattr(current_a.value, attribute)
            distance = abs(d1)
            if distance <= closest_distance and current_a.value.ID not in result:
                closest_distance = distance
                closest_value = current_a.value
            current_a = current_a.next

        if closest_value != None:
            cache["lenD"] = d1
            cache["Geometry"] = closest_value.Geometry
            print(cache)
            result[closest_value.ID] = closest_value.Geometry
        current_b = current_b.next
    
    result = list(result.values())

    # When there are more, you will cut it 
    # if lenD is negativ
    def recursive_reduction():
        iter_pointer = 0
        current_a = current_a.head
        while current_a != None:
            return
    # when ther are less you wiill add 
    # function to check the remaining length and reduce it to within a certain range
    
        
    
    

    return result


result = find_closest_element(things, lines, attribute)


def find_closest_element(target, lst):
    return min(lst, key=lambda x: abs(x - target))

# nearest positive neighbour return null if no bigger is found
def find_closest_larger_element(target, lst):
    temp = [list(filter(lambda x: x>=0, map(lambda x: (x-num), target)))
    for num in lst]
    temp = [sublist[0] if len(sublist) != 0 else None for sublist in temp]
    return temp


def find_closest_elements(list_a, list_b, mode):
    if mode == "cloest":
        return [find_closest_element(target, list_a) for target in list_b]
    elif mode == "cloestPositive":
        return [find_closest_larger_element(target, list_a) if target != None else None
        for target in list_b]


# ID: acd97892-0bdd-4b9d-bde8-80d7d0a14793 (33401)
# ID: a8db58ef-f6cb-45e1-bec1-caf891d357ed (56108)
# ID: d9b60545-1134-4275-858f-04efccc65ece (56107)

a = lines.list_export("Geometry")
# ---------- end script_2 ----------
script_3 = Script(things=script_2.result, lines=uuid_generator.GUID_LINES)  # -> out, geometry, a, b; inputs things: list of Brep; disabled
# ---------- script_3: Python ----------
import Rhino.Geometry as rg

def bounding_box_center_axis(brep):
    # Get the bounding box of the BRep
    bounding_box = brep.GetBoundingBox(False)

    # Calculate the center of the bounding box
    center = bounding_box.Center

    # Get the dimensions of the bounding box
    x_extent = bounding_box.Max.X - bounding_box.Min.X
    y_extent = bounding_box.Max.Y - bounding_box.Min.Y
    z_extent = bounding_box.Max.Z - bounding_box.Min.Z

    # Create the start and end points of the central axis
    start_point = rg.Point3d(center.X - x_extent / 2, center.Y, center.Z)
    end_point = rg.Point3d(center.X + x_extent / 2, center.Y, center.Z)

    # Create a plane using WorldXY as a reference plane
    reference_plane = rg.Plane.WorldXY

    # Translate the plane to the start point
    start_plane = reference_plane.Clone()
    start_plane.Origin = start_point

    # Translate the plane to the end point
    end_plane = reference_plane.Clone()
    end_plane.Origin = end_point

    return rg.LineCurve(start_point, end_point)

geometry = things
a = [bounding_box_center_axis(thing) for thing in things]
b = lines.list_export("Geometry")
# ---------- end script_3 ----------
automatic_updates_on_the_2_layers = Script(Run=run, Reset=reset, Target=100000, Interval=interval)  # -> out, Counter, things, lines; inputs Run: Boolean, Target: Int32, Interval: Int32; disabled
# ---------- automatic_updates_on_the_2_layers: Python ----------
import Rhino
import Grasshopper as gh
doc = Rhino.RhinoDoc.ActiveDoc
LWorkspace = doc.Layers[2]
LStructure = doc.Layers[3]
things = [thing for thing in doc.Objects.FindByLayer(LWorkspace)]
lines = [line for line in doc.Objects.FindByLayer(LStructure)]

a = len(things)
b= len (lines)
def updateComponent(interval):
    
    """ Update this component similar to using a grasshopper timer """
    
    def callBack(e):
        ghenv.Component.ExpireSolution(False)

        if len(things) != a:
            things = [thing for thing in doc.Objects.FindByLayer(LWorkspace)]
        if len(lines) != b:
            lines = [line for line in doc.Objects.FindByLayer(LStructure)]

    ghenv.Component.OnPingDocument().ScheduleSolution(interval,
    gh.Kernel.GH_Document.GH_ScheduleDelegate(callBack))

# Instantiate or reset persistent counter variable
if "count" not in globals() or Reset:
    count = 0

# Update the variable and component
if Run and not Reset and count < Target:
    count +=1
    updateComponent(Interval)

# Output counter
Counter = count
# ---------- end automatic_updates_on_the_2_layers ----------
script_4 = Script()  # -> out, a; disabled
# ---------- script_4: Python ----------
import Rhino
import rhinoscriptsyntax as rs
import Rhino.Geometry as rg

# Namespace definition
# -------------------------------------------------
class GUID:
    def __init__ (self, ID, Geometry,
    Height = None, Width = None, Length = None,
    Axis = None):
        self.ID = ID
        self.Geometry = Geometry #saving the rhino geometry
        self.Height = Height
        self.Width = Width
        self.Length = Length
        self.Axis = Axis

class NODE:
    def __init__(self, value):
        self.right = None
        self.left = None
        self.value = value #self.value = GUID(ID, Geometry)

class BST:
    def __init__(self):
        self.root = None
    
    def insert(self, value):
        Node = NODE(value)
        if self.root == None:
            self.root = Node
            return self

        current = self.root
        while current != None:
            if value > current.value:
                if current.right != None:
                    current = current.right
                else:
                    current.right = Node
                    return self
            else:
                if current.left != None:
                    current = current.left
                else:
                    current.left = Node
                    return self

    def lookup(self, value):
        current = self.root
        while current != None:
            if value == current.value:
                return current

            elif value > current.value:
                current = current.right
            elif current < current.value:
                current = current.left

tree = BST()
# ---------- end script_4 ----------
shortest_list = ShortestList(ListListA=script_3.a, ListListB=script_3.b, TrimMode=2)  # -> ListListA, ListListB; disabled
panel_7 = Panel(script_2.result)
orient = Orient(Geometry=script_3.geometry, Source=shortest_list.ListListA, Target=shortest_list.ListListB)  # -> Geometry, Transform; disabled
panel_8 = Panel(automatic_updates_on_the_2_layers.Counter)  # disabled
panel_9 = Panel(automatic_updates_on_the_2_layers.things)  # disabled
geometry = Geometry(script_3.a)  # disabled
panel_10 = Panel(geometry_pipeline_2)
panel_12 = Panel(script_3.a)
panel_13 = Panel(uuid_generator.GUID_THINGS)
script_5 = Script(things=uuid_generator.GUID_THINGS, lines=uuid_generator.GUID_LINES, attribute="Length")  # -> out, result, plns, a, b, c, d; inputs attribute: String
# ---------- script_5: Python ----------
import rhinoscriptsyntax as rs
import Rhino.Geometry as rg

"""
1. Find closest match using greedy
2. return a list of length difference with pos and neg numbers
3. for the neg number => Cut extra and hence reduce the neg to 0
4. Add the extra piece back to the input and the length.
Stopping conditions are all reaches to 0 or 10 times
"""

# Add stopping Condition and Cycle time
# in Greedy(), it is measuring the length of the line to find best match
# now we have to split the line and push it to linked list a 

def split_by_plane_length(obj, pln, obj_type):
    # pln could be length if obj_type is line
    if obj_type == "Brep":
        bb = rg.Brep.GetBoundingBox(obj,rg.Plane.WorldXY)
        
        
        _,extU,extV = rg.Plane.ExtendThroughBox(pln,bb)
        extU.T0 = extU.T0 - 1
        extU.T1 = extU.T1 + 1
        extV.T0 = extV.T0 - 1
        extV.T1 = extV.T1 + 1
        
        planeSrf = rg.PlaneSurface(pln,extU,extV)
        splitter = planeSrf.ToBrep()

        brep = rs.coercebrep(obj)
        pieces = brep.Split(splitter,0.001)
        pieces = [piece.CapPlanarHoles(0.01)  for piece in pieces]
    if obj_type == "Line":
        start_pt = obj.PointAtStart
        end_pt = obj.PointAtEnd
        print(pln, obj.GetLength())
        pt = obj.PointAtLength(pln)
        line1 = rg.Line(start_pt, pt).ToNurbsCurve()
        line2 = rg.Line(pt, end_pt).ToNurbsCurve()
        pieces = [line2, line1]
    return pieces

def find_closest_element(linked_list_a, linked_list_b, attribute, max_step =2):
    step = 0
    prev = linked_list_b.length
    result = {}
    
    def Greedy(linked_list_a, linked_list_b, attribute):
        current_b = linked_list_b.head
        pointer = 0 
        while current_b != None and current_b.CD != 0:
            if pointer <= prev:
                target = getattr(current_b.value, attribute)
                current_a = linked_list_a.head
                
                while current_a != None:
                    d1 = target - getattr(current_a.value, attribute)
                    distance = abs(d1)
                    if distance <= abs(current_b.CD) and current_a.value.ID not in result:
                        current_b.CD = d1
                        closest_node = current_a
                    current_a = current_a.next

                result[closest_node.value.ID] = 1
                result[current_b.value.ID] = 1
                current_b.closest = closest_node
                
                current_b = current_b.next
                pointer += 1
        return 
    
    def Cut(result, linked_list_a, linked_list_b):
        current = linked_list_b.head #iterate through lines 
        LS = linked_list_b.factory_method()
        while current:
            # split things if things are in excess
            if current.CD < 0:
                scalar = abs(current.CD)
                if attribute == "Length":
                    v = rg.Vector3d(scalar,0,0)
                    pln = current.closest.value.y_cut_plane.Clone()
                elif attribute == "Width":
                    v = rg.Vector3d(0, scalar,0)
                    pln = current.closest.value.x_cut_plane.Clone()
                elif attribute == "Height":
                    v = rg.Vector3d(0,0, scalar)
                    pln = current.closest.value.z_cut_plane.Clone()

                # Split original object according to length difference
                brp = current.closest.value.Geometry
                pln.Translate(v)
                current.closest.value.Cut = pln

                # Split the Brep and lines
                splited = split_by_plane_length(brp, pln, "Brep")
                # split Node
                
                if (len(splited)):
                    current.closest.split(splited, linked_list_a, "Brep")
                # Once split the lengh difference is reduced to 0 
                current.CD = 0
    

            # split the lines if the lines are in excess
            if current.CD >0:
                splited = split_by_plane_length(
                    current.value.Geometry,
                    current.CD,
                    "Line")

                current.value.Geometry = splited[0]
                current.value.update_info()

                GUID = current.value.factory_method(
                    current.value.ID + "/", splited[1], "Line")
                LS.prepend(GUID)
            current = current.next
        prev = LS.length
        return LS.concat(linked_list_b)

    
    # def Cycle (linked_list_a, linked_list_b, attribute, step, max_step):
    #     if step >= max_step:
    #         return result
    #     print(linked_list_a.length)
    #     result = Greedy(linked_list_a, linked_list_b, attribute, Cd_lst)
    #     Cut(result, linked_list_a, linked_list_b, Cd_lst)
    #     step +=1
    #     return Cycle (linked_list_a, linked_list_b, attribute, step, max_step)

        
    while step < max_step:
        print(linked_list_a.length, linked_list_b.length)
        Greedy(linked_list_a, linked_list_b, attribute)
        print("Cut Start!")
        linked_list_b = Cut(result, linked_list_a, linked_list_b)
        print(linked_list_a.length,linked_list_b.length)
        step +=1

    return result,linked_list_a, linked_list_b



result,things,lines = find_closest_element(things, lines, attribute, 2)


plns = things.list_export("Cut")
plns = things.list_export("AxisX")

a = []
b = []
c = []
d = []

current = lines.head
while current != None:
    if current.closest:
        a.append(current.closest.value.Geometry)
        b.append(current.closest.value.AxisX)
        c.append(current.value.Geometry)
    d.append(current.value.Geometry)
    current = current.next
# ---------- end script_5 ----------
brep = Brep(<brep referenced from the Rhino model>)  # disabled
point = Point([Point(7486.975825, 2580.961498, 6063.05932), Point(10446.79449, 1181.677401, 10074.41058)])  # disabled
number_slider = Slider(5, range=0..10)  # disabled
volume = Volume(Geometry=brep)  # -> Volume, Centroid; disabled
# Part1
# dimension of the materials
# what can be used from the database
# 
# 2. Choose a material for the structure
# lines have colours
surface = Surface(script_5.plns)
area = Area(Geometry=surface)  # -> Area, Centroid
# problems to solve
# 
# 1. Maybe change the split to start from the other side of the curve, this is not the most important part.
# 
# 2. Fix issue when you call the function recursively
# the original cloest is shifted.
geometry_2 = Geometry(script_5.plns)
geometry_3 = Geometry(script_5.plns)
move_to_point = MoveToPoint(Geometry=brep, PointA=volume.Centroid, PointB=point)  # -> Moved, Vector, Transform; disabled
list_item = ListItem(List=geometry_3, Index=Slider(1, range=0..10), Wrap=True)
group = Group(Objects=geometry_3)
orient_2 = Orient(Geometry=script_5.a, Source=script_5.b, Target=script_5.c)  # -> Geometry, Transform
# the best match is the newly cutted part which creates this weird shift
scale = Scale(Geometry=surface, Center=area.Centroid, Factor=222)  # -> Geometry, Transform
brep_2 = Brep(<brep referenced from the Rhino model>)  # disabled
brep_3 = Brep(<brep referenced from the Rhino model>)  # disabled
script_6 = Script(connectors=move_to_point.Moved, max_connections=number_slider, structures=orient.Geometry)  # -> out, a; inputs connectors: list of Brep, structures: list of Brep; disabled
# ---------- script_6: Python ----------
import Rhino.Geometry as rg
from ghpythonlib import treehelpers as th
# Script for Connectors 

# Student define where they wanna put connectors
# Could have a potential script to detect the line that are touching
# but not efficient cause it is an O2 operation

# 1.Check all nearby Brep
for connector in connectors:
    result = []
    for structure in structures:
        BD = rg.Brep.CreateBooleanDifference(
            connector,
            structure,
            0.0001)
        if len(BD) != 0:
            print(connector, len(BD))
            result.append(BD)

print(result)
a = th.list_to_tree(result)
# rg.Brep.CreateBooleanDifference()
# ---------- end script_6 ----------
geometry_4 = Geometry(move_to_point.Moved)  # disabled
script_7 = Script(x=brep_2, y=brep_3)  # -> out, a; disabled
# ---------- script_7: Python ----------
import Rhino.Geometry as rg
a = rg.Brep.CreateBooleanDifference(
                x,
                y,
                0.001)
print(a)
# ---------- end script_7 ----------
geometry_5 = Geometry(script_7.a)  # disabled
geometry_6 = Geometry(script_6.a)  # disabled
panel_14 = Panel(geometry_4)  # disabled
panel_15 = Panel(script_6.a)  # disabled
panel_16 = Panel("Optimization")
panel_17 = Panel("Visualization")
