# Grasshopper definition 240123_Graph_Script.gh (Grasshopper 1.0.7)
# plug-ins: RhinoCodePluginGH

geometry_pipeline = GeometryPipeline(
    GroupByLayer=False,
    GroupByType=False,
    IncludeHidden=True,
    IncludeLocked=True,
    LayerFilter="Structure_Types::Typ A",
    NameFilter="*",
    SublayerFiltering=True,
    TypeFilter=4)
geometry_pipeline_2 = GeometryPipeline(
    GroupByLayer=False,
    GroupByType=False,
    IncludeHidden=True,
    IncludeLocked=True,
    LayerFilter="Structure_Types::Typ B",
    NameFilter="*",
    SublayerFiltering=True,
    TypeFilter=4)
geometry_pipeline_3 = GeometryPipeline(
    GroupByLayer=False,
    GroupByType=False,
    IncludeHidden=True,
    IncludeLocked=True,
    LayerFilter="Structure_Types::Typ C",
    NameFilter="*",
    SublayerFiltering=True,
    TypeFilter=4)
geometry_pipeline_4 = GeometryPipeline(
    GroupByLayer=False,
    GroupByType=False,
    IncludeHidden=True,
    IncludeLocked=True,
    LayerFilter="Structure_Types::Typ D",
    NameFilter="*",
    SublayerFiltering=True,
    TypeFilter=4)
geometry_pipeline_5 = GeometryPipeline(
    GroupByLayer=False,
    GroupByType=False,
    IncludeHidden=True,
    IncludeLocked=True,
    LayerFilter="Structure_Types::Typ E",
    NameFilter="*",
    SublayerFiltering=True,
    TypeFilter=4)
geometry_pipeline_6 = GeometryPipeline(
    GroupByLayer=False,
    GroupByType=False,
    IncludeHidden=True,
    IncludeLocked=True,
    LayerFilter="Structure_Types::Typ F",
    NameFilter="*",
    SublayerFiltering=True,
    TypeFilter=4)
geometry_pipeline_7 = GeometryPipeline(
    GroupByLayer=False,
    GroupByType=False,
    IncludeHidden=True,
    IncludeLocked=True,
    LayerFilter="BFH_ReUse24::Workspace",
    NameFilter="*",
    SublayerFiltering=True,
    TypeFilter=1073741848)
run = Button(ExpressionNormal="True", ExpressionPressed="False")
button = Button(ExpressionNormal="True", ExpressionPressed="False")
number_slider = Slider(11, range=0..100)
geometry = Geometry(<curve referenced from the Rhino model>)
geometry_2 = Geometry([<curve referenced from the Rhino model> x4])
geometry_3 = Geometry([<curve referenced from the Rhino model> x6])
panel = Panel("find_within_bound")
panel_2 = Panel("find_closest_with_bound")
panel_3 = Panel("structure_cut")
panel_4 = Panel("material_cut")
script = Script(a=geometry_3, c=geometry_2, e=geometry)  # -> out, lines; inputs a: list of Curve, b: list of Curve, c: list of Curve, d: list of Curve, e: list of Curve, f: list of Curve
# ---------- script: Python ----------
class dict_obj:
    def __init__(self, obj):
        self.obj = obj

lines = dict_obj( {
    "A":a,
    "B":b,
    "C":c,
    "D":d,
    "E":e,
})
# ---------- end script ----------
uuid_generator = Script(things=geometry_pipeline_7, lines=script.lines, run=run, shuffle=Toggle(False))  # -> out, GUID_THINGS, GUID_LINES_A, GUID_LINES; inputs things: list, run: Boolean, seed: Int32
# ---------- uuid_generator: Python ----------
import Rhino
import copy
import rhinoscriptsyntax as rs
import Rhino.Geometry as rg
import random

# Namespace definition
# -------------------------------------------------
class GUID:
    def __init__ (self, ID, Geometry, Type):
        self.ID = ID
        self.Geometry = Geometry 
        self.Type = Type
        self.Cut = None
        self.Connector = None
        self.update_info()
        if self.Type == "Line":
            self.line_type = None

    def update_info(self, mode = None, manual = None):
        if self.Type == "Brep":
            self.info = self.bounding_box_dimensions(self.Geometry)
            self.Length = self.info[0][0]
            self.Width = self.info[0][1]
            self.Height = self.info[0][2]
            self.AxisX = self.info[1][0]
            self.AxisY = self.info[1][1]
            self.AxisZ = self.info[1][2]
            self.x_cut_plane = self.info[2][0]
            self.y_cut_plane = self.info[2][1]
            self.z_cut_plane = self.info[2][2]
            self.Bbox = self.info[3]
        elif self.Type == "Line":
            self.Connector = self.Geometry.PointAtStart
            if type(self.Geometry) == rg.Line:
                self.Length = self.rounding(self.Geometry.Length)
                return
            self.Length = self.rounding(rg.Curve.GetLength(self.Geometry))

    def bounding_box_dimensions(self, obj):
        if type(obj) == rg.Brep:
            vertices = [vertex.Location for vertex in obj.Vertices]
            bounding_box = rg.BoundingBox(vertices)
        else:
            vertices = [vertex.Location for vertex in obj.ToBrep().Vertices]
            bounding_box = rg.BoundingBox(vertices)

        # Calculate the dimensions of the bounding box
       
        x_extent = self.rounding(bounding_box.Max.X - bounding_box.Min.X)
        y_extent = self.rounding(bounding_box.Max.Y - bounding_box.Min.Y)
        z_extent = self.rounding(bounding_box.Max.Z - bounding_box.Min.Z)
        
        # Create the start and end points of the central axis
        center = bounding_box.Center
        start_pointX = rg.Point3d(center.X - x_extent / 2, center.Y, center.Z)
        end_pointX = rg.Point3d(center.X + x_extent / 2, center.Y, center.Z)

        start_pointY = rg.Point3d(center.X , center.Y - y_extent / 2, center.Z)
        end_pointY = rg.Point3d(center.X , center.Y + y_extent / 2, center.Z)

        start_pointZ = rg.Point3d(center.X, center.Y, center.Z -z_extent/2)
        end_pointZ = rg.Point3d(center.X, center.Y, center.Z + z_extent)

        x_line = rg.LineCurve(start_pointX, end_pointX)
        y_line = rg.LineCurve(start_pointY, end_pointY)
        z_line = rg.LineCurve(start_pointZ, end_pointZ)

        x_cut_plane = rg.Plane(rg.Point3d(start_pointX.X, start_pointX.Y-y_extent/2, start_pointX.Z),
        rg.Vector3d(0,1,0))
        y_cut_plane = rg.Plane(rg.Point3d(start_pointY.X - x_extent/2, start_pointY.Y, start_pointY.Z), 
        rg.Vector3d(1,0,0))
        z_cut_plane = rg.Plane(rg.Point3d(start_pointZ.X , start_pointZ.Y, start_pointZ.Z),
        rg.Vector3d(0,0,1))

        return ((x_extent, y_extent, z_extent),
                (x_line, y_line, z_line),
                (x_cut_plane, y_cut_plane, z_cut_plane),
                bounding_box)

    def factory_method(self, ID, Geometry, Type):
        G = GUID(ID, Geometry,Type)
        return G

    def rounding(self, num, decimal_place = 1):
        return round(num, decimal_place)

class NODE:
    def __init__(self, value):
        self.next = None
        self.prev = None
        self.value = value #self.value = GUID(ID, Geometry)
        self.closest = None #for lines, the cloest one to other link list
        self.CD = 100000000

    def split(self, obj, linked_list, obj_type, length = None):
        # Caution: Brep here is a Brep List !!!
        if self.value is not None:
            if obj_type == "Brep":
                self.value.Geometry = obj[0]
                self.value.update_info()
                splited_Node = NODE(GUID(self.value.ID + "/", obj[1], "Brep"))
                splited_Node.next = self.next
                self.next = splited_Node
            if obj_type == "Line":
                # Line is just a single line cryyy so dumb RG
                start_pt = rg.PointAtStart
                end_pt = rg.PointAtEnd
                pt = obj.DivideByLength(length, True, False)
                line1 = rg.Line(start_pt, pt)
                line2 = rg.Line(pt, end_pt)
                self.value.Geometry = line1
                self.value.update_info()
                splited_Node = NODE(GUID(self.value.ID + "/", line2, "Line"))
                splited_Node.next = self.next
                self.next = splited_Node
            
            linked_list.length += 1

    def factory_method(self, ID, obj, obj_type = "Line"):
        N = NODE(value = GUID(ID, obj, obj_type))
        return N


class LINKEDLIST:
    def __init__ (self):
        self.node = None
        self.head = None
        self.tail = None
        self.length = 0
    
    def append(self, value):
        newNode = NODE(value)
        current = self.head
        self.length += 1
        if self.head == None:
            self.head = newNode
            self.tail = newNode
            return newNode
        while current.next != None:
            current = current.next
            
        newNode.prev = current
        current.next = newNode
        self.tail = newNode
        return newNode

    def prepend(self, value):
        newNode = NODE(value)
        self.length +=1

        if self.head == None:
            self.head = newNode
            self.tail = newNode
            return self
        self.head.prev = newNode
        newNode.next = self.head
        self.head = newNode
        return self

    def traverse(self, action = None):
        current = self.head
        while current != None:
            if action:
                action()
            else:
                print(current)
            current = current.next

    def goto(self, position):
        current = self.head
        for i in range(position):
            if current != None:
                current = current.next
            else:
                raise IndexError("Index out of range")

        return current

    def pop(self, position = None):
        if position == None:
            position = self.length -1
            self.length -= 1
        if position == 0:
            if self.head != None:
                pop = self.goto(position)
                self.head = self.head.next
                self.length -= 1
                return pop
            else: 
                raise IndexError("Index out of range")
        if position >= self.length or position < 0:
            raise Exception("index out of range")

        previous = self.goto(position- 1)
        if previous != None and previous.next != None:
            previous.next = previous.next.next
            self.length -= 1
        else:
            raise IndexError("Index out of range")
        return previous

    
    def insert(self, value, position):
        # pass exception here eg position > self.length
        node = NODE(value)
        pointer1 = self.goto(position -1 )
        pointer2 = pointer1.next.next
        pointer1.next = node
        node.prev = pointer1 
        node.next = pointer2
        self.lenth += 1
        return node
    
    def list_export(self, attribute):
        lst = []
        current = self.head
        while current != None:
            value_attribute = getattr(current.value, attribute)
            lst.append(value_attribute)
            current = current.next
        return lst

    def copy(self):
        LS = LINKEDLIST()
        current = self.head
        while current != None:
            new_node = NODE(copy.deepcopy(current.value))
            LS.append(new_node)
            current = current.next
        return LS
    
    def concat(self, linked_list):
        if linked_list.head == None or self.head == None:
            raise Exception("Sorry both list must not be empty la")
        linked_list_tail = linked_list.tail
        linked_list.head.prev = self.tail
        self.tail.next = linked_list.head
        self.tail = linked_list_tail
        self.length += linked_list.length
        return self

    def reverse(self):
        prev = None
        current = self.head
        while(current is not None):
            next = current.next
            current.next = prev
            prev = current
            current = next
        self.head = prev
    
    def factory_method(self):
        LS = LINKEDLIST()
        return LS
# ==============================================================
GUID_LINES= LINKEDLIST()
GUID_LINES_A= LINKEDLIST()
GUID_THINGS = LINKEDLIST()

def shuffle_array(arr, seed=None):
    if seed is not None:
        random.seed(seed)
    n = len(arr)
    for i in range(n-1, 0, -1):
        j = random.randint(0, i)
        arr[i], arr[j] = arr[j], arr[i]
    return arr


if shuffle:
    things= shuffle_array(things, seed= None)
    lines = shuffle_array(lines, seed= None)

def line_rebuild(line):
    if line.PointAtStart.Z > line.PointAtEnd.Z:
        line = rg.Line(line.PointAtEnd,line.PointAtStart).ToNurbsCurve()
    return line

if run:
    for i,thing in enumerate(things):
        thingID = "thing" + str(i)        
        obj = GUID(thingID, thing, "Brep")
        GUID_THINGS.prepend(obj)
        
    for typ in lines.obj:
        if lines.obj[typ]:
            for i, line in enumerate(lines.obj[typ]):
                lineID = "line" + typ + str(i)
                obj = GUID(lineID, line.ToNurbsCurve(), "Line")
                obj.line_type = typ
                GUID_LINES.prepend(obj)

GUID_LINES.traverse()
# ---------- end uuid_generator ----------
script_2 = Script(
    things=uuid_generator.GUID_THINGS,
    lines=uuid_generator.GUID_LINES,
    attribute="Length",
    cut=Toggle(True),
    max_cut=Slider(20, range=0..100),
    max_cycle=Slider(1, range=0..10),
    upper_bound=Slider(10000, range=0..20000),
    lower_bound=Slider(10000, range=0..20000),
    min_len=Slider(0, range=0..4000),
    mode="find_closest")  # -> out, things, lines, result, a; inputs attribute: String, cut: Boolean, max_cut: Int32, max_cycle: Int32, upper_bound: Int32, lower_bound: Int32, min_len: Int32, mode: String, prior: String
# ---------- script_2: Python ----------
import rhinoscriptsyntax as rs
import Rhino.Geometry as rg

"""
1. Find closest match using greedy
2. return a list of length difference with pos and neg numbers
3. for the neg number => Cut extra and hence reduce the neg to 0
4. Add the extra piece back to the input and the length.
Stopping conditions are all reaches to 0 or 10 times
"""

# Add stopping Condition and Cycle time
# in Greedy(), it is measuring the length of the line to find best match
# now we have to split the line and push it to linked list a 

def split_by_plane_length(obj, pln, obj_type):

    # pln could be length if obj_type is line
    if obj_type == "Brep":
        bb = rg.Brep.GetBoundingBox(obj,rg.Plane.WorldXY)
        
        
        _,extU,extV = rg.Plane.ExtendThroughBox(pln,bb)
        extU.T0 = extU.T0 - 1
        extU.T1 = extU.T1 + 1
        extV.T0 = extV.T0 - 1
        extV.T1 = extV.T1 + 1
        
        planeSrf = rg.PlaneSurface(pln,extU,extV)
        splitter = planeSrf.ToBrep()

        brep = rs.coercebrep(obj)
        pieces = brep.Split(splitter,0.001)
        pieces = [piece.CapPlanarHoles(0.01)  for piece in pieces]
    if obj_type == "Line":
        start_pt = obj.PointAtStart
        end_pt = obj.PointAtEnd
        pt = obj.PointAtLength(pln)
        line1 = rg.Line(start_pt, pt).ToNurbsCurve()
        line2 = rg.Line(pt, end_pt).ToNurbsCurve()
        pieces = [line2, line1]
    return pieces

def find_closest_element(linked_list_a, linked_list_b, 
attribute, max_cycle, max_cut, upper_bound, lower_bound, min_len,mode, prior = None, result= None):
    step = 0
    cut_count = 0
    prev = linked_list_b.length

    if result == None:
        result = {}
    else:
        result = result.obj

    if linked_list_b.length > linked_list_a.length:
        raise Exception("Number of input lines are more than available object")
        return

    def Greedy(linked_list_a, linked_list_b, attribute):
        current_b = linked_list_b.head
        pointer = 0 
        while current_b != None and current_b.CD != 0:
            closest_node = None
            if pointer <= prev and current_b.value.line_type != "A":
                current_a = linked_list_a.head
                while current_a != None and current_a.value.Length > min_len:
                    d1 = current_b.value.Length - getattr(current_a.value, attribute)
                    if mode == "find_closest":
                        if prior == None:
                            # Default
                            if abs(d1) <= abs(current_b.CD)  and current_a.value.ID not in result:
                                current_b.CD = d1
                                closest_node = current_a
                    elif mode == "find_closest_with_bound":
                        if prior == None:
                            # Default
                            if abs(d1) <= abs(current_b.CD) and  -lower_bound <= d1 <= upper_bound and current_a.value.ID not in result:
                                    current_b.CD = d1
                                    closest_node = current_a
                        if prior == "material_cut":
                            if d1<0 and abs(d1) <= abs(current_b.CD) and  -lower_bound <= d1 <= upper_bound and current_a.value.ID not in result:
                                    current_b.CD = d1
                                    closest_node = current_a
                        if prior == "structure_cut":
                            if d1>0 and abs(d1) <= abs(current_b.CD) and  -lower_bound <= d1 <= upper_bound and current_a.value.ID not in result:
                                    current_b.CD = d1
                                    closest_node = current_a
                    elif mode == "find_within_bound":
                        if prior == "material_cut":
                            if d1 < 0 and -lower_bound <= d1 <= upper_bound and current_a.value.ID not in result:
                                current_b.CD = d1
                                closest_node = current_a
                                break
                        if prior == "structure_cut":
                            if d1 >= 0 and -lower_bound <= d1 <= upper_bound and current_a.value.ID not in result:
                                current_b.CD = d1
                                closest_node = current_a
                                break
                        if prior == None:
                            # Default
                            if -lower_bound <= d1 <= upper_bound and current_a.value.ID not in result:
                                current_b.CD = d1
                                closest_node = current_a
                                break

                    current_a = current_a.next
                
            if closest_node != None:
                result[closest_node.value.ID] = 1
                result[current_b.value.ID] = 1
            current_b.closest = closest_node
            
            current_b = current_b.next
            pointer += 1
        return 
    
    def Cut(result, linked_list_a, linked_list_b):
        current = linked_list_b.head #iterate through lines 
        LS = linked_list_b.factory_method()
        pointer = 0
        nonlocal prev
        nonlocal cut_count
        while current and pointer <= prev:
            # split things if things are in excess
            if current.CD < 0 and current.closest != None:
                scalar = abs(current.CD)
                if attribute == "Length":
                    v = rg.Vector3d(scalar,0,0)
                    pln = current.closest.value.y_cut_plane.Clone()
                elif attribute == "Width":
                    v = rg.Vector3d(0, scalar,0)
                    pln = current.closest.value.x_cut_plane.Clone()
                elif attribute == "Height":
                    v = rg.Vector3d(0,0, scalar)
                    pln = current.closest.value.z_cut_plane.Clone()

                # Split original object according to length difference
                brp = current.closest.value.Geometry
                pln.Translate(v)
                current.closest.value.Cut = pln

                # Split the Brep and lines                
                splited = split_by_plane_length(brp, pln, "Brep")
                # split Node
            
                if (len(splited)):
                    current.closest.split(splited, linked_list_a, "Brep")
                    cut_count += 1

            # split the lines if the lines are in excess
            if current.CD >0 and current.closest != None:
                splited = split_by_plane_length(
                    current.value.Geometry,
                    current.CD,
                    "Line")

                current.value.Geometry = splited[0]
                current.value.update_info()

                GUID = current.value.factory_method(
                    current.value.ID + "/", splited[1], "Line")
                LS.prepend(GUID)

            #once splited reduce CD to 0
            current.CD = 0
            current = current.next
            pointer += 1
        prev = LS.length
        if LS.length == 0:
            return linked_list_b
        return LS.concat(linked_list_b)

        
    while step < max_cycle:
        print(linked_list_a.length, linked_list_b.length)
        Greedy(linked_list_a, linked_list_b, attribute)
        print("Cut Start!")
        if cut:
            linked_list_b = Cut(result, linked_list_a, linked_list_b)
            print(linked_list_a.length,linked_list_b.length)
        step +=1
    return result,linked_list_a, linked_list_b



result,things,lines = find_closest_element(things, lines, 
attribute, max_cycle, max_cut, upper_bound, lower_bound, min_len, mode, prior)


current = lines.head
a = []
pointer = 0
while current:
    if current.closest:
        print(pointer, current.closest.value, current.CD)
    current = current.next
    pointer +=1


# Stupid GH cant pass dictionary
class DICT:
    def __init__ (self, obj):
        self.obj = obj
result = DICT(result)
# ---------- end script_2 ----------
geometry_4 = Geometry(<point referenced from the Rhino model>)
list_item = ListItem(List=script_2.a, Index=0, Wrap=True)
visualizer = Script(things=script_2.things, lines=script_2.lines)  # -> out, plns, a, b, c, d, e, msg
# ---------- visualizer: Python ----------
plns = things.list_export("Cut")
plnS = things.list_export("y_cut_plane")


a = []
b = []
c = []
d = []
e = []

msg = 0
current = lines.head
while current != None:
    if current.closest:
        a.append(current.closest.value.Geometry)
        b.append(current.closest.value.AxisX)
        c.append(current.value.Geometry)
        msg += current.closest.value.Length
    d.append(current.value.Geometry)
    e.append(current.value.Connector)
    current = current.next
# ---------- end visualizer ----------
geometry_5 = Geometry(script_2.a)
# if the student already knows what is in the DB,
script_3 = Script(lines=script.lines, x=geometry_4)  # -> out, a
# ---------- script_3: Python ----------
import Rhino.Geometry as rg


# NameSpace
# ==================================================================================================    
class Edge:
    def __init__(self, ID, key, geometry, edge_type):
        self.ID = ID
        self.key = key
        self.geometry = geometry
        self.edge_type = edge_type
        self.edge_length = geometry.GetLength()

class Node:
    def __init__(self, geometry, coordinate_movement = None):
        self.geometry = geometry
        self.edge = []
        self.coordinate_movement = coordinate_movement
# -----------------------------------------------------------------
class Graph:
    def __init__(self, adjacency_list, number_of_edge):
        self.adjacency_list = adjacency_list
        self.number_of_nodes = len(adjacency_list)
        self.number_of_edge = number_of_edge


    def get_edge(self, pt):
        coordinate = (pt.X, pt.Y, pt.Z)
        key =  f"{int(pt.X)}_{int(pt.Y)}_{int(pt.Z)}"
        if key in self.adjacency_list:
            print([i.edge_type for i in self.adjacency_list[key].edge])
            edge = map(lambda x:  self.adjacency_list[x.key].geometry,
            self.adjacency_list[key].edge)
            return list(edge)
        else:
            return None
    
    def find_closest_element(self):
        # traverse through the Graph and for each edge if its not type A not the cloest match
        return

    def traverse(self, function_call= None):
        traveled = {}
        for node in self.adjacency_list:
            # point_to_go_to is a list of Edge object and you wanna update them
            # by performing cloest match eg function_call = self.find_closest_element
            for edge in self.adjacency_list[node].edge:
                if edge.ID not in traveled:
                    function_call(edge)
                    traveled[edge.ID] =1

        # update the edge instance with the new line and length 
        # in the edge.points attribute based on each rules of the point, perform different operataion
        # such that it meets the new length
        return
    
    def get_node(self,pt):
        coordinate = (pt.X, pt.Y, pt.Z)
        key =  f"{int(pt.X)}_{int(pt.Y)}_{int(pt.Z)}"
        if key in self.adjacency_list:
            return self.adjacency_list[key]
        else:
            return None

    @classmethod
    def get_graph(cls, lines):
        # lines is an object containing a dictionary eg lines.obj
        def get_adjacency_list(lines):
            adjacency_list = {}
            number_of_edge = 0
            for typ in lines.obj:
                if lines.obj[typ] !=None:
                    number_of_edge += len(lines.obj[typ])
                    for line in lines.obj[typ]:
                        st_pt = line.PointAtStart
                        end_pt = line.PointAtEnd
                        coordinate1 = (st_pt.X, st_pt.Y, st_pt.Z)
                        coordinate2 = (end_pt.X, end_pt.Y, end_pt.Z)
                        key1 = f"{int(st_pt.X)}_{int(st_pt.Y)}_{int(st_pt.Z)}"
                        key2 = f"{int(end_pt.X)}_{int(end_pt.Y)}_{int(end_pt.Z)}"

                        line_UID = key1 + "::" + key2
                        edge1 = Edge(line_UID, key1, line, typ)
                        edge2 = Edge(line_UID,key2, line, typ)

                        if key1 not in adjacency_list:
                            adjacency_list[key1] = Node(st_pt, coordinate_movement= typ)
                            adjacency_list[key1].edge.append(edge2)
                            
                        else:
                            adjacency_list[key1].edge.append(edge2)
                                
                        if key2 not in adjacency_list:
                            adjacency_list[key2] = Node(end_pt, coordinate_movement= typ)
                            adjacency_list[key2].edge.append(edge1)
                
                        else:
                            adjacency_list[key2].edge.append(edge1)

            return adjacency_list, number_of_edge
        
        adjacency_list, number_of_edge = get_adjacency_list(lines)
        return cls(adjacency_list, number_of_edge)
# ==================================================================================================
# dicitony on if the length is changable for the  type, 0 = fixed length
dependecy_list = {"A":0,"B":1,"C":1,"D":0,"E":1,"F":0,}

graph1 = Graph.get_graph(lines)
a = graph1.get_edge(x)
graph1.get_node(x)
graph1.traverse(print)
# ---------- end script_3 ----------
# Task today
# 1. update the point movment based on the type
# 2. fixed bug on why the first piece has no cloests element
# 3. Type A immediately get length
geometry_6 = Geometry(visualizer.c)
orient = Orient(Geometry=visualizer.a, Source=visualizer.b, Target=visualizer.c)  # -> Geometry, Transform
surface = Surface(visualizer.plns)
# Task
# 1. Perform find cloest match for all the edge.
line = Line(StartPoint=geometry_4, EndPoint=script_3.a)
geometry_7 = Geometry(visualizer.d)
group = Group(Objects=geometry_6)
area = Area(Geometry=surface)  # -> Area, Centroid
custom_preview = CustomPreview(Geometry=visualizer.a, Material=ColourSwatch(SwatchColor=RGB(13, 150, 181)))
end_points = EndPoints(Curve=geometry_7)  # -> Start, End
scale = Scale(Geometry=surface, Center=area.Centroid, Factor=222)  # -> Geometry, Transform
geometry_8 = Geometry(end_points.Start)
